# Grasshopper definition FacadeEmbed_JinQiao_Podium.gh (Grasshopper 1.0.7)
# plug-ins: EleFront, Wombat, TT Toolbox, Pufferfish, Hare, treesloth01

# ----
# 线段延长长度
number_slider = Slider(1001, range=0..10000)  # disabled

# ----
# remove duplicate curves
geo = Geometry()  # disabled
number_slider_2 = Slider(0.1, range=0..0.1)  # disabled
boundary = BoundarySurfaces(Edges=geo)  # disabled
area = Area(Geometry=boundary)  # -> Area, Centroid; disabled
cullduppoints = RemoveDuplicatePoints(InputPoints=area.Centroid, Tolerance=number_slider_2)  # -> OutputPoints, FirstPointIndexes; disabled
null = NullItem(Item=cullduppoints.FirstPointIndexes)  # -> NullFlags, InvalidFlags, Description; disabled
dispatch = Dispatch(List=boundary, DispatchPattern=null.NullFlags)  # -> ListA, ListB; disabled
geo_2 = Geometry(dispatch.ListA)  # disabled

# ----
# 调换阴阳角设定
toggle = BooleanToggle(False)  # disabled

# ----
# 按图层整理curves
# 2.Line-0-建筑
# 3.Line-1-结构
panel = Panel("Line-0-建筑-Whole")
reflay = ReferenceByLayer(LayerName="Line-1-檐口")
reflay_2 = ReferenceByLayer(LayerName="Line-1-结构-Out")
reflay_3 = ReferenceByLayer(LayerName=panel)
reflay_4 = ReferenceByLayer(LayerName="Line-1-结构-All")

# ----
# 1.按图层整理curves
# 1.Line-1-建筑-
panel_2 = Panel("Line-1-建筑-Whole")
reflay_5 = ReferenceByLayer(LayerName=panel_2)

# ----
# Input Blocks (Correct Plan)
# 主体定位点
data = Data(["PX-GLAZ-F2$0$PX-GLAZ-F1$0$标准块", "PX-GLAZ-F2$0$PX-GLAZ-F2$0$标准块", "PX-GLAZ-F2$0$PX-GLAZ-F3$0$标准块"])

# ----
# Input Curves
# 主体定位点（按图层导入）
crv = Curve(<curve referenced from the Rhino model>)

# ----
# Input Blocks (Wrong Plan)
# 主体定位点
data_2 = Data("PX-GLAZ-F2$0$T3T")

# ----
# （1）导入埋件定位点
# Block & Curve的形式
# block names
listblockd = ListBlockDocument()
panel_3 = Panel(listblockd)

# ----
# 按图层整理curves
# 1.导入建筑线：Arch_curve_
panel_4 = Panel("Arch_curve_smooth")
reflay_6 = ReferenceByLayer(LayerName="Arch_curve_Whole")
reflay_7 = ReferenceByLayer(LayerName=panel_4)
reflay_8 = ReferenceByLayer(LayerName="Arch_curve_withLocation")
reflay_9 = ReferenceByLayer(LayerName="Arch_curve_angular")

# ----
# 特殊建筑线
# This Project Only
panel_5 = Panel("Arch_curve_other")
reflay_10 = ReferenceByLayer(LayerName=panel_5)

# ----
# 1.输入block names
# Later:
# 1.Block -Plane-不同方向合并处理
# 
# 2.双层幕墙的处理
data_3 = Data(["PX-GLAZ-F2$0$PX-GLAZ-F2$0$fin", "PX-GLAZ-F2$0$PX-GLAZ-F1$0$fin"])
panel_6 = Panel(data_3)

# ----
# （0）Prep
# 检测Block的Plane
# block names
listblockd_2 = ListBlockDocument()
panel_8 = Panel(listblockd_2)
refblock = ReferenceBlockByName(BlockName=panel_6)
deblock = DeconstructBlock(Block=refblock)  # -> Name, Plane, Geometry

# ----
# 2.导入所有结构线
panel_9 = Panel("Structure_curve_all")
reflay_11 = ReferenceByLayer(LayerName=panel_9)

# ----
# 单体选型
list = ValueList({"板埋": 0, "槽埋": 1, "板槽埋": 2}, selected="槽埋")
list_2 = ValueList({"顶埋": 0, "侧埋": 1}, selected="顶埋")
panel_10 = Panel(list)
panel_11 = Panel(list_2)

layer = ObjectLayer(Guid=crv)  # -> LayerIndex, LayerPathName
panel_12 = Panel(data)
panel_14 = Panel(data_2)
panel_15 = Panel(layer.LayerPathName)
refblock_2 = ReferenceBlockByName(BlockName=panel_12)
refblock_3 = ReferenceBlockByName(BlockName=panel_14)
reflay_12 = ReferenceByLayer(LayerName=panel_15)
xy = XYPlane(Origin=Point(0, 0, 0))
xy_2 = XYPlane(Origin=Point(0, 0, 0))
xy_3 = XYPlane(Origin=Point(0, 0, 0))
project = Project(Geometry=refblock_3, Plane=xy_3)  # -> Geometry, Transform
project_2 = Project(Geometry=refblock_2, Plane=xy_2)  # -> Geometry, Transform
project_3 = Project(Geometry=reflay_12, Plane=xy)  # -> Geometry, Transform

# ---- group: 结构线
crv_2 = Curve(<curve referenced from the Rhino model>)

# ----
# 平面定位INPUT
crv_3 = Curve([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])

# ---- group: 玻璃线
玻璃线 = Curve(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)
玻璃线_2 = Curve(<curve referenced from the Rhino model>)
玻璃线_3 = Curve(<curve referenced from the Rhino model>)

# ---- group: 定位竖料
crv_4 = Curve([<curve referenced from the Rhino model> x300])
crv_5 = Curve([<curve referenced from the Rhino model> x180])
crv_6 = Curve([<curve referenced from the Rhino model> x383])

# ----
# （3）导入局部单体建筑的参考线
# 按照图层导入建筑、结构、檐口线
xy_4 = XYPlane(Origin=Point(0, 0, 0))
xy_5 = XYPlane(Origin=Point(0, 0, 0))
xy_6 = XYPlane(Origin=Point(0, 0, 0))
xy_7 = XYPlane(Origin=Point(0, 0, 0))
xy_8 = XYPlane(Origin=Point(0, 0, 0))
project_4 = Project(Geometry=reflay_5, Plane=xy_4)  # -> Geometry, Transform
project_5 = Project(Geometry=reflay, Plane=xy_5)  # -> Geometry, Transform
project_6 = Project(Geometry=reflay_2, Plane=xy_6)  # -> Geometry, Transform
project_7 = Project(Geometry=reflay_3, Plane=xy_8)  # -> Geometry, Transform
project_8 = Project(Geometry=reflay_4, Plane=xy_7)  # -> Geometry, Transform
crv_7 = Curve(project_4.Geometry)
crv_8 = Curve(project_8.Geometry)
crv_9 = Curve(project_6.Geometry)
crv_10 = Curve(project_7.Geometry)
crv_11 = Curve(project_5.Geometry)
crv_12 = Curve(<curve referenced from the Rhino model>)

# ----
# （2）导入整个site的参考线
# 按照图层导入所有的建筑、结构、檐口线
xy_9 = XYPlane(Origin=Point(0, 0, 0))
xy_10 = XYPlane(Origin=Point(0, 0, 0))
xy_11 = XYPlane(Origin=Point(0, 0, 0))
xy_12 = XYPlane(Origin=Point(0, 0, 0))
xy_13 = XYPlane(Origin=Point(0, 0, 0))
xy_14 = XYPlane(Origin=Point(0, 0, 0))
project_9 = Project(Geometry=reflay_6, Plane=xy_9)  # -> Geometry, Transform
project_10 = Project(Geometry=reflay_7, Plane=xy_10)  # -> Geometry, Transform
project_11 = Project(Geometry=reflay_8, Plane=xy_11)  # -> Geometry, Transform
project_12 = Project(Geometry=reflay_9, Plane=xy_12)  # -> Geometry, Transform
project_13 = Project(Geometry=reflay_10, Plane=xy_13)  # -> Geometry, Transform
project_14 = Project(Geometry=reflay_11, Plane=xy_14)  # -> Geometry, Transform
crv_13 = Curve(project_10.Geometry)
crv_14 = Curve(project_11.Geometry)
crv_15 = Curve(project_12.Geometry)
crv_16 = Curve(project_9.Geometry)
crv_17 = Curve(project_13.Geometry)
crv_18 = Curve(project_14.Geometry)

# ---- group: 混凝土
# 板埋几何INPUT
list_3 = ValueList({"C15": 0, "C20": 1, "C25": 2, "C30": 3, "C35": 4, "C40": 5}, selected="C35")

# ---- group: 钢筋牌号
list_4 = ValueList({"HPB300": 0, "HRB400": 1}, selected="HPB300")

# ---- group: 直径
list_5 = ValueList({"10": 0, "12": 1, "16": 2, "18": 3, "20": 4, "25": 5}, selected="12")

# ---- group: 列
list_6 = ValueList({"2X": 0, "3X": 1, "4X": 2}, selected="3X")

# ---- group: 行
list_7 = ValueList({"2Y": 0, "3Y": 1, "4Y": 2}, selected="2Y")

# ---- group: 锚筋间距
s_x = Slider(22, range=14..60, expression="X*5")
s_y = Slider(22, range=14..60, expression="X*5")

# ----
crv_19 = Curve([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])

# ----
# 2.检测plane是否存在
pln = Plane(deblock.Plane)

# ----
# 槽埋-角部选择
list_8 = ValueList({"槽埋角部-L形": 0, "槽埋角部-I形": 1}, selected="槽埋角部-I形")

join = JoinCurves(Curves=crv_19, Preserve=False)

# ----
# 3.如果不存在则Blake geometry
# 并在rhino里面清理线段
geo_3 = Geometry(deblock.Geometry)

flip = FlipCurve(Curve=玻璃线)  # -> Curve, Flag
boundary_2 = BoundarySurfaces(Edges=join)
filter = StreamFilter(Gate=Toggle(True), Stream0=玻璃线, Stream1=flip.Curve)
sunion = SolidUnion(Breps=boundary_2)
offset = OffsetCurve(Curve=filter, Distance=expr("-x", Slider(375, range=0..1000)), Corners=1)
area_2 = Area(Geometry=sunion)  # -> Area, Centroid
pt = Point(area_2.Centroid)
explode = Explode(Curve=offset, Recursive=True)  # -> Segments, Vertices
pt_2 = Point(explode.Vertices)
entwine = Entwine(Branch00=sunion, Branch01=pt, FlattenInputs=True)
max = Maximum(A=s_x, B=s_y)
flip_2 = FlipMatrix(Data=entwine)
filter_2 = StreamFilter(Gate=list_3, Stream0=7.2, Stream1=9.6, Stream2=11.9, Stream3=14.3, Stream4=16.7, Stream5=19.1)
filter_3 = StreamFilter(Gate=list_4, Stream0=270, Stream1=360)
filter_4 = StreamFilter(Gate=list_5, Stream0=10, Stream1=12, Stream2=16, Stream3=18, Stream4=20, Stream5=25)
filter_5 = StreamFilter(Gate=list_3, Stream0=0.91, Stream1=1.1, Stream2=1.27, Stream3=1.43, Stream4=1.57, Stream5=1.71)
filter_6 = StreamFilter(Gate=list_4, Stream0=0.16, Stream1=0.14)
addition = Addition(A=list_6, B=1)
addition_2 = Addition(A=list_7, B=1)
division = Division(A=max, B=8)
crv_20 = Curve(crv_8)
crv_21 = Curve(crv_10)

# ---- group: 建筑定位轮廓
item = ListItem(List=flip_2, Index="0", Wrap=True)  # -> flatten(Item)

# ---- group: 埋件定位点
item_2 = ListItem(List=flip_2, Index="-1", Wrap=True)  # -> flatten(Item)

# ----
t = Integer(division)
panel_16 = Panel(filter_5)
panel_17 = Panel(filter_2)
panel_18 = Panel(filter_6)
min = Minimum(A=filter_3, B=300)
panel_19 = Panel(min)
expression = Expression(A=filter_6, fy=filter_3, ft=filter_5, d=filter_4, Expression="(int((0.6*1.1*A*fy/ft*d)/5)+1)*5")

# ----
# 导入槽埋模型
brep = Brep(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)

# ---- group: 槽埋
# 槽埋Modeling
brep_2 = Brep(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)
bbox = BoundingBox(Content=brep, Plane=PlaneXY(0, 0, 0))  # -> Box, Box_2
debox = DeconstructBox(Box=bbox.Box)  # -> Plane, X, Y, Z
area_3 = Area(Geometry=brep)  # -> Area, Centroid
pdecon = Deconstruct(Point=area_3.Centroid)  # -> XComponent, YComponent, ZComponent
dedomain = DeconstructDomain(Domain=debox.Z)  # -> Start, End
xy_15 = XYPlane(Origin=Point(0, 0, 0))
pt_3 = ConstructPoint(XCoordinate=pdecon.XComponent, YCoordinate=pdecon.YComponent, ZCoordinate=dedomain.End)
pl_origin = PlaneOrigin(Base=xy_15, Origin=pt_3)
xy_16 = XYPlane(Origin=Point(0, 0, 0))
orient = Orient(Geometry=brep, Source=pl_origin, Target=xy_16)  # -> Geometry, Transform

# ----
edges = BrepEdges(Brep=bbox.Box)  # -> Naked, Interior, NonManifold
item_3 = ListItem(List=edges.Interior, Index="5", Wrap=True)
item_4 = ListItem(List=edges.Interior, Index="4", Wrap=True)
clx = CurveLine(Curve=item_4, Line=item_3)  # -> Points, Params, Count
Y = UnitY(Factor=item_3)
rotate = Rotate(Geometry=brep, Angle=1.570796327, Plane=clx.Points)  # -> Geometry, Transform
move = Move(Geometry=rotate.Geometry, Motion=Y)  # -> Geometry, Transform
merge = Merge(Data1=brep, Data2=move.Geometry)  # -> flatten(Result)
sunion_2 = SolidUnion(Breps=merge)
bbox_2 = BoundingBox(Content=sunion_2, Plane=PlaneXY(0, 0, 0))  # -> Box, Box_2
area_4 = Area(Geometry=sunion_2)  # -> Area, Centroid
debox_2 = DeconstructBox(Box=bbox_2.Box)  # -> Plane, X, Y, Z
pdecon_2 = Deconstruct(Point=area_4.Centroid)  # -> XComponent, YComponent, ZComponent
dedomain_2 = DeconstructDomain(Domain=debox_2.Z)  # -> Start, End
pt_4 = ConstructPoint(XCoordinate=pdecon_2.XComponent, YCoordinate=pdecon_2.YComponent, ZCoordinate=dedomain_2.End)
xy_17 = XYPlane(Origin=Point(0, 0, 0))
pl_origin_2 = PlaneOrigin(Base=xy_17, Origin=pt_4)
xy_18 = XYPlane(Origin=Point(0, 0, 0))
orient_2 = Orient(Geometry=sunion_2, Source=pl_origin_2, Target=xy_18)  # -> Geometry, Transform

# ----
# 导入槽埋模型
brep_3 = Brep(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)

filter_7 = StreamFilter(Gate=list_8, Stream0=orient_2.Geometry, Stream1=orient.Geometry)
entwine_2 = Entwine(Branch00=orient.Geometry, Branch01=filter_7, FlattenInputs=True)
crv_22 = Curve(offset)
crv_23 = Curve([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])
crv_24 = Curve(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)
merge_2 = Merge(Data1=crv_23, Data2=crv_24)

# ----
# 选要重塑的线段长度
number_slider_3 = Slider(1200, range=0..10000)

# ----
# 调整重塑线段的平滑度
number_slider_4 = Slider(11, range=0..11)

# ----
# 根据F2建筑线制作轮廓线
crv_25 = Curve(crv_7)
explode_2 = Explode(Curve=crv_25, Recursive=True)  # -> Segments, Vertices
len = Length(Curve=explode_2.Segments)
sort = SortList(Keys=len)  # -> Keys, ValuesA
larger = LargerThan(FirstNumber=len, SecondNumber=number_slider_3)  # -> LargerThan, OrEqualTo
panel_20 = Panel(sort.Keys)
dispatch_2 = Dispatch(List=explode_2.Segments, DispatchPattern=larger.LargerThan)  # -> ListA, ListB
data_4 = Data(dispatch_2.ListA)
data_5 = Data(dispatch_2.ListB)
join_2 = JoinCurves(Curves=data_5, Preserve=False)
disc = Discontinuity(Curve=join_2, Level=1)  # -> Points, Parameters
nurbs = NurbsCurve(Vertices=disc.Points, Degree=number_slider_4, Periodic=False)  # -> flatten(Curve), Length, Domain
join_3 = JoinCurves(Curves=flatten([data_4, nurbs.Curve]), Preserve=False)
offset_2 = OffsetCurve(Curve=join_3, Distance=Slider(6859, range=0..10000), Corners=1)

# ----
# 半手动??
reb = RebuildCurve(Curve=offset_2, Count=Slider(17, range=0..100), Tangents=invert(False))

list_9 = ValueList({"Default Curve": 0, "Input Curve": 1}, selected="Default Curve")
crv_26 = Curve()
filter_8 = StreamFilter(Gate=list_9, Stream0=reb, Stream1=crv_26)

# ----
# 梁宽根据tag
number_slider_5 = Slider(150, range=0..1000)

# ----
# 区分内外梁边线-精确offset还没加
crv_27 = Curve(crv_8)
crv_28 = Curve(filter_8)
offcrv = OffsetCurve(
    Curve=crv_27,
    Plane=PlaneXY(0, 0, 0),
    Distance=number_slider_5,
    BothSides=expr("-x", number_slider_5),
    Kinks=0,
    CapType="0")
midpt = CurveMiddle(Curve=offcrv)
midpt_2 = CurveMiddle(Curve=crv_27)
crv_29 = Curve(offcrv)
item_5 = ListItem(List=midpt, Index=0, Wrap=True)
item_6 = ListItem(List=crv_29, Index=0, Wrap=True)
item_7 = ListItem(List=crv_29, Index="-1", Wrap=True)
pull = PullPoint(Point=midpt_2, Geometry=crv_28, ClosestOnly=True)  # -> ClosestPoint, Distance
ln = Line(StartPoint=item_5, EndPoint=graft(pull.ClosestPoint))
graft = GraftTree(Tree=crv_27, IncludeEmptyLists=True, IncludeNullItems=True)
ccx = CurveCurve(CurveA=ln, CurveB=graft)  # -> Points, ParamsA, ParamsB
null_2 = NullItem(Item=ccx.Points)  # -> NullFlags, InvalidFlags, Description
dispatch_3 = Dispatch(List=item_7, DispatchPattern=null_2.InvalidFlags)  # -> ListA, ListB
dispatch_4 = Dispatch(List=item_6, DispatchPattern=null_2.InvalidFlags)  # -> ListA, ListB

# ----
# 梁边线-内
merge_3 = Merge(Data1=dispatch_4.ListB, Data2=dispatch_3.ListA)

# ----
# 梁边线-外
merge_4 = Merge(Data1=dispatch_4.ListA, Data2=dispatch_3.ListB)

crv_30 = Curve(merge_4)

# ----
# 1/2梁宽
# 给多少？？
number_slider_6 = Slider(150, range=0..1000)

crv_31 = Curve(crv_8)

# ----
# 下层幕墙边线在结构边梁以内>350
# （最外层结构线）
number_slider_7 = Slider(350, range=0..1000)

# ----
# remove wrong lines
number_slider_8 = Slider(600, range=0..1000)

# ----
# remove wrong lines
number_slider_9 = Slider(600, range=0..1000)

crv_32 = Curve(merge_4)

# ----
# Sort Text
panel_21 = Panel("""T2-PLAN-F2$0$次梁编号
T2-PLAN-F2$0$框梁编号""")
reflay_13 = ReferenceByLayer(LayerName=panel_21)  # -> flatten(Geometry)
panel_22 = Panel("""GL3-1
GL4-1
GL5-1
GL5-2
GL6-1
GL6-2
GKL6-2
GL7-1
GL7-2
GKL7-1
GL8-1
GL8-2
GKl7-1
GKl7-4
GKL9-2
GL10-1
GL10-4
GKL10-2
GKL10-4
GL12-1""")
detext = DeconstructText(TextObject=reflay_13)  # -> Text, Plane, Height, Justification
lng = ListLength(List=detext.Text)
tmatch = MatchText(Text=detext.Text, Pattern=graft(panel_22), Case=True)
tsort = SortText(Keys=detext.Text, Culture=127)  # -> Keys, Values
pt_5 = Point(detext.Plane)
dispatch_5 = Dispatch(List=reflay_13, DispatchPattern=tmatch)  # -> ListA, ListB
panel_23 = Panel(lng)
panel_24 = Panel(tsort.Keys)
data_6 = Data(dispatch_5.ListA)
bang = ExplodeTree(Data=data_6)  # -> Branch0, Branch1, Branch2, Branch3, Branch4, Branch5, Branch6, Branch7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
flatten = FlattenTree(Tree=data_6, Path="{0}")
lng_2 = ListLength(List=flatten)
equals = Equality(FirstNumber=panel_23, SecondNumber=lng_2)  # -> Equality, Inequality
filter_9 = StreamFilter(Gate=equals.Equality, Stream0="Missing Text!", Stream1="Correct!")
panel_25 = Panel(filter_9)
detext_2 = DeconstructText(TextObject=bang.Branch0)  # -> Text, Plane, Height, Justification
detext_3 = DeconstructText(TextObject=bang.Branch1)  # -> Text, Plane, Height, Justification
detext_4 = DeconstructText(TextObject=bang.Branch2)  # -> Text, Plane, Height, Justification
detext_5 = DeconstructText(TextObject=bang.Branch3)  # -> Text, Plane, Height, Justification
detext_6 = DeconstructText(TextObject=bang.Branch4)  # -> Text, Plane, Height, Justification
detext_7 = DeconstructText(TextObject=bang.Branch5)  # -> Text, Plane, Height, Justification
detext_8 = DeconstructText(TextObject=bang.Branch6)  # -> Text, Plane, Height, Justification
detext_9 = DeconstructText(TextObject=bang.Branch7)  # -> Text, Plane, Height, Justification
detext_10 = DeconstructText(TextObject=bang.Branch8)  # -> Text, Plane, Height, Justification
detext_11 = DeconstructText(TextObject=bang.Branch9)  # -> Text, Plane, Height, Justification
detext_12 = DeconstructText(TextObject=bang.Branch10)  # -> Text, Plane, Height, Justification
detext_13 = DeconstructText(TextObject=bang.Branch11)  # -> Text, Plane, Height, Justification
detext_14 = DeconstructText(TextObject=bang.Branch12)  # -> Text, Plane, Height, Justification
detext_15 = DeconstructText(TextObject=bang.Branch13)  # -> Text, Plane, Height, Justification
detext_16 = DeconstructText(TextObject=bang.Branch14)  # -> Text, Plane, Height, Justification
detext_17 = DeconstructText(TextObject=bang.Branch15)  # -> Text, Plane, Height, Justification
detext_18 = DeconstructText(TextObject=bang.Branch16)  # -> Text, Plane, Height, Justification
detext_19 = DeconstructText(TextObject=bang.Branch17)  # -> Text, Plane, Height, Justification
detext_20 = DeconstructText(TextObject=bang.Branch18)  # -> Text, Plane, Height, Justification
detext_21 = DeconstructText(TextObject=bang.Branch19)  # -> Text, Plane, Height, Justification
pt_6 = Point(detext_2.Plane)
pt_7 = Point(detext_3.Plane)
pt_8 = Point(detext_4.Plane)
pt_9 = Point(detext_5.Plane)
pt_10 = Point(detext_6.Plane)
pt_11 = Point(detext_7.Plane)
pt_12 = Point(detext_8.Plane)
pt_13 = Point(detext_9.Plane)
pt_14 = Point(detext_10.Plane)
pt_15 = Point(detext_12.Plane)
pt_16 = Point(detext_13.Plane)
pt_17 = Point(detext_14.Plane)
pt_18 = Point(detext_15.Plane)
pt_19 = Point(detext_16.Plane)
pt_20 = Point(detext_17.Plane)
pt_21 = Point(detext_18.Plane)
pt_22 = Point(detext_19.Plane)
pt_23 = Point(detext_11.Plane)
pt_24 = Point(detext_20.Plane)
pt_25 = Point(detext_21.Plane)
merge_5 = Merge(
    Data1=pt_6,
    Data2=pt_7,
    Data3=pt_8,
    Data4=pt_9,
    Data5=pt_10,
    Data6=pt_11,
    Data7=pt_12,
    Data8=pt_13,
    Data9=pt_14,
    Data10=pt_23,
    Data11=pt_15,
    Data12=pt_17,
    Data13=pt_18,
    Data14=pt_19,
    Data15=pt_20,
    Data16=pt_21,
    Data17=pt_22,
    Data18=pt_16,
    Data19=pt_24,
    Data20=pt_25)
flatten_2 = FlattenTree(Tree=merge_5, Path="{0}")

crv_33 = Curve(crv_20)
crv_34 = Curve(crv_21)
offset_3 = OffsetCurve(Curve=crv_34, Distance=expr("-x", Slider(5000, range=0..10000)), Corners=1)
offset_4 = OffsetCurve(Curve=crv_34, Distance=Slider(1000, range=0..1000), Corners=1)
close = CloseCurve(Curve=offset_3, Tolerance=0)
close_2 = CloseCurve(Curve=offset_4, Tolerance=0)
boundary_3 = BoundarySurfaces(Edges=[close_2, close])
scx = SurfaceCurve(Surface=boundary_3, Curve=graft(crv_33))  # -> Curves, Points, UVPoints, Normals, Parameters, Tangents
null_3 = NullItem(Item=scx.Curves)  # -> NullFlags, simplify(InvalidFlags), Description
dispatch_6 = Dispatch(List=simplify(graft(crv_33)), DispatchPattern=null_3.InvalidFlags)  # -> ListA, ListB
data_7 = Data(dispatch_6.ListB)
number_slider_10 = Slider(3000, range=0..10000)
ext = ExtendCurve(Curve=flatten(data_7), Type=0, Start=number_slider_10, End=number_slider_10)  # -> flatten(Curve)
crv_35 = Curve(offset_4)
ccx_2 = CurveCurve(CurveA=ext, CurveB=crv_35)  # -> Points, ParamsA, ParamsB
null_4 = NullItem(Item=ccx_2.Points)  # -> NullFlags, simplify(InvalidFlags), Description
dispatch_7 = Dispatch(List=simplify(graft(data_7)), DispatchPattern=null_4.InvalidFlags)  # -> ListA, ListB
number_slider_11 = Slider(3000, range=0..10000)
data_8 = Data(flatten(dispatch_7.ListA))
ext_2 = ExtendCurve(Curve=flatten(data_8), Type=0, Start=number_slider_11, End=number_slider_11)  # -> flatten(Curve)
crv_36 = Curve(close)
ccx_3 = CurveCurve(CurveA=ext_2, CurveB=crv_36)  # -> Points, ParamsA, ParamsB
null_5 = NullItem(Item=ccx_3.Points)  # -> NullFlags, simplify(InvalidFlags), Description
dispatch_8 = Dispatch(List=simplify(graft(data_8)), DispatchPattern=null_5.InvalidFlags)  # -> ListA, ListB
data_9 = Data(dispatch_8.ListB)
data_10 = Data(dispatch_7.ListB)
crv_37 = Curve()
merge_6 = Merge(Data1=data_10, Data2=data_9)
midpt_3 = CurveMiddle(Curve=merge_6)
end = EndPoints(Curve=merge_6)  # -> Start, End
crv_cp = CurveClosestPoint(Point=midpt_3, Curve=crv_37)  # -> Point, Parameter, Distance
ln_2 = Line(StartPoint=end.Start, EndPoint=end.End)
eval = EvaluateCurve(Curve=crv_37, Parameter=crv_cp.Parameter)  # -> Point, Tangent, Angle
angle = Angle(VectorA=flatten(eval.Tangent), VectorB=flatten(ln_2))  # -> Angle, Reflex
deg = Degrees(Radians=angle.Angle)
larger_2 = LargerThan(FirstNumber=deg, SecondNumber=Slider(55, range=0..100))  # -> LargerThan, OrEqualTo
dispatch_9 = Dispatch(List=flatten(merge_6), DispatchPattern=larger_2.LargerThan)  # -> ListA, ListB
dispatch_10 = Dispatch(List=flatten(deg), DispatchPattern=larger_2.LargerThan)  # -> ListA, ListB
data_11 = Data(dispatch_9.ListA)
data_12 = Data(dispatch_10.ListA)
panel_26 = Panel(deg)
smaller = SmallerThan(FirstNumber=data_12, SecondNumber=Slider(153, range=0..1000))  # -> SmallerThan, OrEqualTo
dispatch_11 = Dispatch(List=data_11, DispatchPattern=smaller.SmallerThan)  # -> ListA, ListB
data_13 = Data(dispatch_11.ListB)
data_14 = Data(dispatch_9.ListB)
data_15 = Data(dispatch_8.ListA)
merge_7 = Merge(Data1=data_13, Data2=data_14, Data3=data_15)  # -> flatten(Result)
list_10 = ValueList({"Default Curve": 0, "Input Curve": 1}, selected="Default Curve")
crv_38 = Curve()
data_16 = Data(dispatch_11.ListA)
filter_10 = StreamFilter(Gate=list_10, Stream0=merge_7, Stream1=crv_38)

# ----
# all analysised curves
crv_39 = Curve(data_7)

# ----
# 求内部曲线转折点
crv_40 = Curve()  # disabled
number_slider_12 = Slider(300, range=0..1000)  # disabled
neg = Negative(Value=number_slider_12)  # disabled
filter_11 = StreamFilter(Gate=toggle, Stream0=number_slider_12, Stream1=neg)  # disabled
number_slider_13 = Slider(60, range=0..100)  # disabled

ext_3 = ExtendCurve(Curve=crv_40, Type=0, Start=number_slider, End=number_slider)  # disabled

# ----
# 第二层
# 
# Curves(location point)+ Smooth Curves(architecture line)
# 第二层-区分阴阳角
area_5 = Area(Geometry=geo_2)  # -> Area, Centroid; disabled
crv_41 = Curve(crv_40)  # disabled
pull_2 = PullPoint(Point=area_5.Centroid, Geometry=crv_41, ClosestOnly=True)  # -> ClosestPoint, Distance; disabled
number_slider_14 = Slider(200, range=0..1000)  # disabled
number_slider_15 = Slider(100, range=0..300)  # disabled

# ----
# 第二层-阴阳角
panel_27 = Panel("0.5 * Pi")  # disabled
toggle_2 = BooleanToggle(True)  # disabled
neg_2 = Negative(Value=panel_27)  # disabled
filter_12 = StreamFilter(Gate=toggle_2, Stream0=panel_27, Stream1=neg_2)  # disabled

# ----
# 第二层-大面定位
panel_28 = Panel("0.5 * Pi")  # disabled
toggle_3 = BooleanToggle(True)  # disabled
neg_3 = Negative(Value=panel_28)  # disabled
filter_13 = StreamFilter(Gate=toggle_3, Stream0=panel_28, Stream1=neg_3)  # disabled

number_slider_16 = Slider(300, range=0..1000)  # disabled
number_slider_17 = Slider(1.5, range=0..10)  # disabled

number_slider_18 = Slider(300, range=0..1000)  # disabled
number_slider_19 = Slider(1.5, range=0..10)  # disabled

number_slider_20 = Slider(300, range=0..1000)  # disabled
number_slider_21 = Slider(1.5, range=0..10)  # disabled

# ----
# 显示"False"时要选择线段延长
list_11 = ValueList({"线段不延长": 0, "线段延长": 1}, selected="线段延长")  # disabled

filter_14 = StreamFilter(Gate=list_11, Stream0=crv_40, Stream1=ext_3)  # disabled

disc_2 = Discontinuity(Curve=graft(filter_14), Level=1)  # -> Points, Parameters; disabled
crv_cp_2 = CurveClosestPoint(Point=disc_2.Points, Curve=graft(filter_14))  # -> Point, Parameter, Distance; disabled
eval_2 = EvaluateCurve(Curve=graft(filter_14), Parameter=crv_cp_2.Parameter)  # -> flatten(Point), Tangent, flatten(Angle); disabled
deg_2 = Degrees(Radians=eval_2.Angle)  # disabled
offset_5 = OffsetCurve(Curve=filter_14, Distance=expr("-X", filter_11), Corners=1)  # disabled
panel_29 = Panel(deg_2)  # disabled
larger_3 = LargerThan(FirstNumber=deg_2, SecondNumber=number_slider_13)  # -> LargerThan, OrEqualTo; disabled
disc_3 = Discontinuity(Curve=offset_5, Level=1)  # -> flatten(Points), Parameters; disabled
dispatch_12 = Dispatch(List=eval_2.Point, DispatchPattern=larger_3.LargerThan)  # -> ListA, ListB; disabled
end_2 = EndPoints(Curve=filter_14)  # -> Start, End; disabled
data_17 = Data(dispatch_12.ListA)  # disabled
pull_3 = PullPoint(Point=data_17, Geometry=flatten(offset_5), ClosestOnly=True)  # -> ClosestPoint, Distance; disabled
testpoint = TestPoint(archPoint=pull_3.ClosestPoint, crvPoint=disc_3.Points)  # -> out, specialPt; inputs archPoint: list of Point3d, crvPoint: list of Point3d; disabled
# ---------- testpoint: C# ----------
    List<int> passIndex = new List<int>();

    for(int i = 0; i < archPoint.Count; i++){
      foreach(Point3d t in crvPoint){
        if(archPoint[i].X == t.X && archPoint[i].Y == t.Y && archPoint[i].Z == t.Z){
          Print("pass");
          passIndex.Add(i);}
      }
    }

    specialPt = passIndex;
# ---------- end testpoint ----------

# ----
# 阴角
item_8 = ListItem(List=data_17, Index=testpoint.specialPt, Wrap=True)  # disabled

# ----
# SmoothCurve-阴角&阳角
# 阳角
cull_i = CullIndex(List=data_17, Indices=testpoint.specialPt, Wrap=True)  # disabled

dist = Distance(PointA=pull_2.ClosestPoint, PointB=data_17)  # disabled
sort_2 = SortList(Keys=dist)  # -> Keys, ValuesA; disabled
panel_30 = Panel(sort_2.Keys)  # disabled
smaller_2 = SmallerThan(FirstNumber=dist, SecondNumber=number_slider_14)  # -> SmallerThan, OrEqualTo; disabled
dispatch_13 = Dispatch(List=geo_2, DispatchPattern=smaller_2.SmallerThan)  # -> ListA, ListB; disabled
crv_42 = Curve(filter_14)  # disabled

data_18 = Data(dispatch_13.ListA)  # disabled
explode_3 = Explode(Curve=data_18, Recursive=True)  # -> Segments, Vertices; disabled
len_2 = Length(Curve=explode_3.Segments)  # disabled
sort_3 = SortList(Keys=reverse(len_2), ValuesA=explode_3.Segments)  # -> Keys, ValuesA; disabled
item_9 = ListItem(List=sort_3.ValuesA, Index=0, Wrap=True)  # -> flatten(Item); disabled
area_6 = Area(Geometry=data_18)  # -> Area, Centroid; disabled
midpt_4 = CurveMiddle(Curve=item_9)  # disabled
move2pt = MoveToPoint(Geometry=item_9, PointA=midpt_4, PointB=area_6.Centroid)  # -> Moved, Vector, Transform; disabled
end_3 = EndPoints(Curve=move2pt.Moved)  # -> Start, End; disabled
ln_3 = Line(StartPoint=end_3.Start, EndPoint=end_3.End)  # disabled
xy_19 = XYPlane(Origin=end_3.End)  # disabled
rotate_2 = Rotate(Geometry=ln_3, Angle=filter_12, Plane=xy_19)  # -> Geometry, Transform; disabled
pl = ConstructPlane(Origin=end_3.End, XAxis=rotate_2.Geometry, YAxis=ln_3)  # disabled

data_19 = Data(dispatch_13.ListB)  # disabled
explode_4 = Explode(Curve=data_19, Recursive=True)  # -> Segments, Vertices; disabled
len_3 = Length(Curve=explode_4.Segments)  # disabled
sort_4 = SortList(Keys=reverse(len_3), ValuesA=explode_4.Segments)  # -> Keys, ValuesA; disabled
item_10 = ListItem(List=sort_4.ValuesA, Index=0, Wrap=True)  # -> flatten(Item); disabled
area_7 = Area(Geometry=data_19)  # -> Area, Centroid; disabled
midpt_5 = CurveMiddle(Curve=item_10)  # disabled
move2pt_2 = MoveToPoint(Geometry=item_10, PointA=midpt_5, PointB=area_7.Centroid)  # -> Moved, Vector, Transform; disabled
end_4 = EndPoints(Curve=move2pt_2.Moved)  # -> Start, End; disabled
ln_4 = Line(StartPoint=end_4.Start, EndPoint=end_4.End)  # disabled
xy_20 = XYPlane(Origin=end_4.End)  # disabled
rotate_3 = Rotate(Geometry=ln_4, Angle=filter_13, Plane=xy_20)  # -> Geometry, Transform; disabled
pl_2 = ConstructPlane(Origin=end_4.End, XAxis=rotate_3.Geometry, YAxis=ln_4)  # disabled

data_20 = Data(flatten(pl_2))  # disabled
deplane = DeconstructPlane(Plane=data_20)  # -> Origin, XAxis, YAxis, ZAxis; disabled
amp = Amplitude(Vector=deplane.YAxis, Amplitude=number_slider_18)  # disabled
move_2 = Move(Geometry=deplane.Origin, Motion=amp)  # -> Geometry, Transform; disabled
ln_5 = Line(StartPoint=deplane.Origin, EndPoint=move_2.Geometry)  # disabled
midpt_6 = CurveMiddle(Curve=ln_5)  # disabled
scale = Scale(Geometry=ln_5, Center=midpt_6, Factor=number_slider_19)  # -> Geometry, Transform; disabled
ccx_4 = CurveCurve(CurveA=scale.Geometry, CurveB=crv_42)  # -> Points, ParamsA, ParamsB; disabled

dist_2 = Distance(PointA=graft(end_3.End), PointB=cull_i)  # disabled
sort_5 = SortList(Keys=dist_2)  # -> Keys, ValuesA; disabled
item_11 = ListItem(List=sort_5.Keys, Index=0, Wrap=True)  # disabled
smaller_3 = SmallerThan(FirstNumber=item_11, SecondNumber=number_slider_15)  # -> SmallerThan, OrEqualTo; disabled
flatten_3 = FlattenTree(Tree=item_11, Path="{0}")  # disabled
dispatch_14 = Dispatch(List=graft(pl), DispatchPattern=smaller_3.SmallerThan)  # -> ListA, ListB; disabled
panel_31 = Panel(flatten_3)  # disabled
flatten_4 = FlattenTree(Tree=ccx_4.Points, Path="{0}")  # disabled
lng_3 = ListLength(List=scale.Geometry)  # disabled
lng_4 = ListLength(List=flatten_4)  # disabled

data_21 = Data(flatten(dispatch_14.ListA))  # disabled
deplane_2 = DeconstructPlane(Plane=data_21)  # -> Origin, XAxis, YAxis, ZAxis; disabled
amp_2 = Amplitude(Vector=deplane_2.YAxis, Amplitude=number_slider_16)  # disabled
move_3 = Move(Geometry=deplane_2.Origin, Motion=amp_2)  # -> Geometry, Transform; disabled
ln_6 = Line(StartPoint=deplane_2.Origin, EndPoint=move_3.Geometry)  # disabled
midpt_7 = CurveMiddle(Curve=ln_6)  # disabled
scale_2 = Scale(Geometry=ln_6, Center=midpt_7, Factor=number_slider_17)  # -> Geometry, Transform; disabled
ccx_5 = CurveCurve(CurveA=scale_2.Geometry, CurveB=crv_42)  # -> Points, ParamsA, ParamsB; disabled

data_22 = Data(flatten(dispatch_14.ListB))  # disabled
deplane_3 = DeconstructPlane(Plane=data_22)  # -> Origin, XAxis, YAxis, ZAxis; disabled
amp_3 = Amplitude(Vector=deplane_3.YAxis, Amplitude=number_slider_20)  # disabled
move_4 = Move(Geometry=deplane_3.Origin, Motion=amp_3)  # -> Geometry, Transform; disabled
ln_7 = Line(StartPoint=deplane_3.Origin, EndPoint=move_4.Geometry)  # disabled
midpt_8 = CurveMiddle(Curve=ln_7)  # disabled
scale_3 = Scale(Geometry=ln_7, Center=midpt_8, Factor=number_slider_21)  # -> Geometry, Transform; disabled
ccx_6 = CurveCurve(CurveA=scale_3.Geometry, CurveB=crv_42)  # -> Points, ParamsA, ParamsB; disabled

equals_2 = Equality(FirstNumber=lng_3, SecondNumber=lng_4)  # -> Equality, Inequality; disabled
panel_32 = Panel(equals_2.Equality)  # disabled

# ----
# InsideCurve-大面
move2pt_3 = MoveToPoint(Geometry=data_20, PointA=flatten(deplane.Origin), PointB=flatten(ccx_4.Points))  # -> Moved, Vector, Transform; disabled

# ----
# InsideCurve-阳角
move2pt_4 = MoveToPoint(Geometry=data_21, PointA=deplane_2.Origin, PointB=ccx_5.Points)  # -> Moved, Vector, Transform; disabled

# ----
# InsideCurve-阴角
move2pt_5 = MoveToPoint(Geometry=data_22, PointA=deplane_3.Origin, PointB=ccx_6.Points)  # -> Moved, Vector, Transform; disabled

# ----
# 测试Smooth Curve是否与每个Block相切
# blocks + smooth curves
# remove duplicate blocks
# blocks + special curves
deblock_2 = DeconstructBlock(Block=project_2.Geometry)  # -> Name, Plane, Geometry
pln_2 = Plane(flatten(deblock_2.Plane))
deplane_4 = DeconstructPlane(Plane=pln_2)  # -> Origin, XAxis, YAxis, ZAxis
cullduppoints_2 = RemoveDuplicatePoints(InputPoints=deplane_4.Origin, Tolerance=0.001)  # -> OutputPoints, FirstPointIndexes
null_6 = NullItem(Item=cullduppoints_2.FirstPointIndexes)  # -> NullFlags, InvalidFlags, Description
dispatch_15 = Dispatch(List=pln_2, DispatchPattern=null_6.InvalidFlags)  # -> ListA, ListB
dispatch_16 = Dispatch(List=flatten(project_2.Geometry), DispatchPattern=null_6.InvalidFlags)  # -> ListA, ListB
pln_3 = Plane(dispatch_15.ListA)
data_23 = Data(flatten(pln_3))
deplane_5 = DeconstructPlane(Plane=data_23)  # -> Origin, XAxis, YAxis, ZAxis
pln_4 = Plane(data_23)
amp_4 = Amplitude(Vector=deplane_5.YAxis, Amplitude=Slider(300, range=0..1000))
move_5 = Move(Geometry=deplane_5.Origin, Motion=amp_4)  # -> Geometry, Transform
ln_8 = Line(StartPoint=deplane_5.Origin, EndPoint=move_5.Geometry)
crv_43 = Curve(crv_13)
midpt_9 = CurveMiddle(Curve=ln_8)
scale_4 = Scale(Geometry=ln_8, Center=midpt_9, Factor=Slider(7.8, range=0..10))  # -> Geometry, Transform
merge_8 = Merge(Data1=scale_4.Geometry, Data2=crv_43)
mcx = MultipleCurves(Curves=flatten(merge_8))  # -> Points, IndexA, IndexB, ParamA, ParamB
cull_i_2 = CullIndex(List=flatten(pln_4), Indices=mcx.IndexA, Wrap=True)
item_12 = ListItem(List=pln_4, Index=mcx.IndexA, Wrap=True)
pln_5 = Plane(cull_i_2)
pln_6 = Plane(item_12)

deblock_3 = DeconstructBlock(Block=dispatch_16.ListA)  # -> Name, Plane, Geometry
data_24 = Data(dispatch_16.ListA)

cull_i_3 = CullIndex(List=flatten(data_24), Indices=mcx.IndexA, Wrap=True)
item_13 = ListItem(List=flatten(data_24), Index=mcx.IndexA, Wrap=True)
data_25 = Data(cull_i_3)
data_26 = Data(item_13)

# ----
# 第一层
# 
# Special Curves(architecture line)
crv_44 = Curve(crv_14)
pln_7 = Plane(pln_5)
deplane_6 = DeconstructPlane(Plane=pln_7)  # -> Origin, XAxis, YAxis, ZAxis
disc_4 = Discontinuity(Curve=crv_44, Level=1)  # -> Points, Parameters
pull_4 = PullPoint(Point=deplane_6.Origin, Geometry=disc_4.Points, ClosestOnly=True)  # -> ClosestPoint, Distance
sort_6 = SortList(Keys=pull_4.Distance)  # -> reverse(Keys), ValuesA
panel_33 = Panel(sort_6.Keys)
larger_4 = LargerThan(FirstNumber=pull_4.Distance, SecondNumber=Slider(300, range=0..1000))  # -> LargerThan, OrEqualTo
dispatch_17 = Dispatch(List=pln_7, DispatchPattern=larger_4.LargerThan)  # -> ListA, ListB
data_27 = Data(dispatch_17.ListB)
deplane_7 = DeconstructPlane(Plane=data_27)  # -> Origin, XAxis, YAxis, ZAxis
pull_5 = PullPoint(Point=deplane_7.Origin, Geometry=disc_4.Points, ClosestOnly=True)  # -> ClosestPoint, Distance
pl_3 = ConstructPlane(Origin=pull_5.ClosestPoint, XAxis=deplane_7.XAxis, YAxis=deplane_7.YAxis)

# ----
# 测试Smooth Curve是否与每个Block相切
# blocks + smooth curves
# remove duplicate blocks
# blocks + special curves
deblock_4 = DeconstructBlock(Block=project.Geometry)  # -> Name, Plane, Geometry
pln_8 = Plane(flatten(deblock_4.Plane))
deplane_8 = DeconstructPlane(Plane=pln_8)  # -> Origin, XAxis, YAxis, ZAxis
cullduppoints_3 = RemoveDuplicatePoints(InputPoints=deplane_8.Origin, Tolerance=0.001)  # -> OutputPoints, FirstPointIndexes
null_7 = NullItem(Item=cullduppoints_3.FirstPointIndexes)  # -> NullFlags, InvalidFlags, Description
dispatch_18 = Dispatch(List=pln_8, DispatchPattern=null_7.InvalidFlags)  # -> ListA, ListB
dispatch_19 = Dispatch(List=flatten(project.Geometry), DispatchPattern=null_7.InvalidFlags)  # -> ListA, ListB
pln_9 = Plane(dispatch_18.ListA)
data_28 = Data(flatten(pln_9))
deplane_9 = DeconstructPlane(Plane=data_28)  # -> Origin, XAxis, YAxis, ZAxis
pln_10 = Plane(data_28)
amp_5 = Amplitude(Vector=deplane_9.YAxis, Amplitude=Slider(300, range=0..1000))
move_6 = Move(Geometry=deplane_9.Origin, Motion=amp_5)  # -> Geometry, Transform
ln_9 = Line(StartPoint=deplane_9.Origin, EndPoint=move_6.Geometry)
crv_45 = Curve(crv_13)
midpt_10 = CurveMiddle(Curve=ln_9)
scale_5 = Scale(Geometry=ln_9, Center=midpt_10, Factor=Slider(7.8, range=0..10))  # -> Geometry, Transform
merge_9 = Merge(Data1=scale_5.Geometry, Data2=crv_45)
mcx_2 = MultipleCurves(Curves=flatten(merge_9))  # -> Points, IndexA, IndexB, ParamA, ParamB
cull_i_4 = CullIndex(List=flatten(pln_10), Indices=mcx_2.IndexA, Wrap=True)
item_14 = ListItem(List=pln_10, Index=mcx_2.IndexA, Wrap=True)
pln_11 = Plane(cull_i_4)
pln_12 = Plane(item_14)

deblock_5 = DeconstructBlock(Block=dispatch_19.ListA)  # -> Name, Plane, Geometry
data_29 = Data(dispatch_19.ListA)

cull_i_5 = CullIndex(List=flatten(data_29), Indices=mcx_2.IndexA, Wrap=True)
item_15 = ListItem(List=flatten(data_29), Index=mcx_2.IndexA, Wrap=True)
data_30 = Data(cull_i_5)
data_31 = Data(item_15)

# ---- group: 阴阳角区分
cp = ClosestPoint(Point=pt_2, Cloud=item_2)  # -> ClosestPoint, CPIndex, Distance
item_16 = ListItem(List=item_2, Index=cp.CPIndex, Wrap=True)
crv_cp_3 = CurveClosestPoint(Point=item_16, Curve=offset)  # -> Point, Parameter, Distance
eval_3 = EvaluateCurve(Curve=offset, Parameter=crv_cp_3.Parameter)  # -> Point, Tangent, Angle

# ----
# 板槽埋Modeling
multiplication = Multiplication(A=s_x, B=addition)
multiplication_2 = Multiplication(A=s_y, B=addition_2)
recgrid = Rectangular(Plane=PlaneXY(0, 0, 0), SizeX=s_x, SizeY=s_y, ExtentX=addition, ExtentY=addition_2)  # -> Cells, Points
直径 = Text(filter_4)
division_2 = Division(A=multiplication, B=2)
division_3 = Division(A=multiplication_2, B=2)
vec = VectorXYZ(XComponent=expr("-x", division_2), YComponent=expr("-x", division_3), ZComponent=0)  # -> Vector, Length
move_7 = Move(Geometry=recgrid.Points, Motion=vec.Vector)  # -> Geometry, Transform
division_4 = Division(A=直径, B=2)
cyl = Cylinder(Base=move_7.Geometry, Radius=division_4, Length=expr("-x", expression))
X = UnitX(Factor=直径)
multiplication_3 = Multiplication(A=直径, B=6)
edges_2 = BrepEdges(Brep=cyl)  # -> Naked, Interior, NonManifold
item_17 = ListItem(List=edges_2.Naked, Index=0, Wrap=True)
max_2 = Maximum(A=multiplication_3, B=70)
move_8 = Move(Geometry=item_17, Motion=X)  # -> Geometry, Transform
multiplication_4 = Multiplication(A=max_2, B=2)
addition_3 = Addition(A=multiplication, B=multiplication_4)
addition_4 = Addition(A=multiplication_2, B=multiplication_4)
division_5 = Division(A=t, B=2)
expression_2 = Expression(x=addition_4, Expression="Ceiling(x/10)*10/2")
expression_3 = Expression(x=addition_3, Expression="Ceiling(x/10)*10/2")
round = Round(Number=division_5)  # -> Nearest, Floor, Ceiling
multiplication_5 = Multiplication(A=round.Ceiling, B=2)
dom = ConstructDomain(DomainStart=expr("-x", expression_2), DomainEnd=expression_2)
dom_2 = ConstructDomain(DomainStart=expr("-x", expression_3), DomainEnd=expression_3)
box = DomainBox(Base=PlaneXY(0, 0, 0), X=dom_2, Y=dom, Z=multiplication_5)
Z = UnitZ(Factor=expr("-x", multiplication_5))

multiplication_6 = Multiplication(A=直径, B=5)

Z_2 = UnitZ(Factor=multiplication_6)
extr = Extrude(Base=move_8.Geometry, Direction=Z_2)
cap = CapHoles(Brep=[extr, cyl])
merge_10 = Merge(Data1=cap, Data2=box)
flatten_5 = FlattenTree(Tree=merge_10, Path="{0}")
move_9 = Move(Geometry=flatten_5, Motion=Z)  # -> Geometry, Transform

brep_4 = Brep(move_9.Geometry)

# ----
# 槽埋+板埋合并
bbox_3 = BoundingBox(Content=brep_3, Plane=PlaneXY(0, 0, 0))  # -> Box, Box_2
debox_3 = DeconstructBox(Box=bbox_3.Box)  # -> Plane, X, Y, Z
area_8 = Area(Geometry=brep_3)  # -> Area, Centroid
dedomain_3 = DeconstructDomain(Domain=debox_3.Z)  # -> Start, End
pdecon_3 = Deconstruct(Point=area_8.Centroid)  # -> XComponent, YComponent, ZComponent
xy_21 = XYPlane(Origin=Point(0, 0, 0))
pt_26 = ConstructPoint(XCoordinate=pdecon_3.XComponent, YCoordinate=pdecon_3.YComponent, ZCoordinate=dedomain_3.End)
pl_origin_3 = PlaneOrigin(Base=xy_21, Origin=pt_26)
xy_22 = XYPlane(Origin=Point(0, 0, 0))
orient_3 = Orient(Geometry=brep_3, Source=pl_origin_3, Target=xy_22)  # -> Geometry, Transform
bbox_4 = BoundingBox(Content=orient_3.Geometry, Plane=PlaneXY(0, 0, 0))  # -> Box, Box_2
sdiff = SolidDifference(BrepsA=move_9.Geometry, BrepsB=bbox_4.Box)
sunion_3 = SolidUnion(Breps=[sdiff, orient_3.Geometry])  # -> flatten(Result)

edges_3 = BrepEdges(Brep=bbox_3.Box)  # -> Naked, Interior, NonManifold
item_18 = ListItem(List=edges_3.Interior, Index="5", Wrap=True)
item_19 = ListItem(List=edges_3.Interior, Index="4", Wrap=True)
clx_2 = CurveLine(Curve=item_19, Line=item_18)  # -> Points, Params, Count
Y_2 = UnitY(Factor=item_18)
rotate_4 = Rotate(Geometry=brep_3, Angle=1.570796327, Plane=clx_2.Points)  # -> Geometry, Transform
move_10 = Move(Geometry=rotate_4.Geometry, Motion=Y_2)  # -> Geometry, Transform
merge_11 = Merge(Data1=brep_3, Data2=move_10.Geometry)  # -> flatten(Result)
sunion_4 = SolidUnion(Breps=merge_11)
bbox_5 = BoundingBox(Content=sunion_4, Plane=PlaneXY(0, 0, 0))  # -> Box, Box_2
area_9 = Area(Geometry=sunion_4)  # -> Area, Centroid
debox_4 = DeconstructBox(Box=bbox_5.Box)  # -> Plane, X, Y, Z
pdecon_4 = Deconstruct(Point=area_9.Centroid)  # -> XComponent, YComponent, ZComponent
dedomain_4 = DeconstructDomain(Domain=debox_4.Z)  # -> Start, End
pt_27 = ConstructPoint(XCoordinate=pdecon_4.XComponent, YCoordinate=pdecon_4.YComponent, ZCoordinate=dedomain_4.End)
xy_23 = XYPlane(Origin=Point(0, 0, 0))
pl_origin_4 = PlaneOrigin(Base=xy_23, Origin=pt_27)
xy_24 = XYPlane(Origin=Point(0, 0, 0))
orient_4 = Orient(Geometry=sunion_4, Source=pl_origin_4, Target=xy_24)  # -> Geometry, Transform

entwine_3 = Entwine(Branch00=sunion_3, Branch01=orient_4.Geometry, FlattenInputs=True)

# ----
# 板埋Modeling
multiplication_7 = Multiplication(A=s_x, B=addition)
multiplication_8 = Multiplication(A=s_y, B=addition_2)
recgrid_2 = Rectangular(Plane=PlaneXY(0, 0, 0), SizeX=s_x, SizeY=s_y, ExtentX=addition, ExtentY=addition_2)  # -> Cells, Points
直径_2 = Text(filter_4)
division_6 = Division(A=multiplication_7, B=2)
division_7 = Division(A=multiplication_8, B=2)
vec_2 = VectorXYZ(XComponent=expr("-x", division_6), YComponent=expr("-x", division_7), ZComponent=0)  # -> Vector, Length
move_11 = Move(Geometry=recgrid_2.Points, Motion=vec_2.Vector)  # -> Geometry, Transform
division_8 = Division(A=直径_2, B=2)
cyl_2 = Cylinder(Base=move_11.Geometry, Radius=division_8, Length=expr("-x", expression))
X_2 = UnitX(Factor=直径_2)
multiplication_9 = Multiplication(A=直径_2, B=6)
edges_4 = BrepEdges(Brep=cyl_2)  # -> Naked, Interior, NonManifold
item_20 = ListItem(List=edges_4.Naked, Index=0, Wrap=True)
max_3 = Maximum(A=multiplication_9, B=70)
move_12 = Move(Geometry=item_20, Motion=X_2)  # -> Geometry, Transform
multiplication_10 = Multiplication(A=max_3, B=2)
addition_5 = Addition(A=multiplication_7, B=multiplication_10)
addition_6 = Addition(A=multiplication_8, B=multiplication_10)
division_9 = Division(A=t, B=2)
expression_4 = Expression(x=addition_6, Expression="Ceiling(x/10)*10/2")
expression_5 = Expression(x=addition_5, Expression="Ceiling(x/10)*10/2")
round_2 = Round(Number=division_9)  # -> Nearest, Floor, Ceiling
multiplication_11 = Multiplication(A=round_2.Ceiling, B=2)
dom_3 = ConstructDomain(DomainStart=expr("-x", expression_4), DomainEnd=expression_4)
dom_4 = ConstructDomain(DomainStart=expr("-x", expression_5), DomainEnd=expression_5)
box_2 = DomainBox(Base=PlaneXY(0, 0, 0), X=dom_4, Y=dom_3, Z=multiplication_11)
Z_3 = UnitZ(Factor=expr("-x", multiplication_11))
move_13 = Move(Geometry=box_2, Motion=Z_3)  # -> Geometry, Transform
Z_4 = UnitZ(Factor=expr("-x", multiplication_11))

multiplication_12 = Multiplication(A=直径_2, B=5)

Z_5 = UnitZ(Factor=multiplication_12)
extr_2 = Extrude(Base=move_12.Geometry, Direction=Z_5)
cap_2 = CapHoles(Brep=[extr_2, cyl_2])
merge_12 = Merge(Data1=cap_2, Data2=box_2)
flatten_6 = FlattenTree(Tree=merge_12, Path="{0}")
move_14 = Move(Geometry=flatten_6, Motion=Z_4)  # -> Geometry, Transform

box_3 = DomainBox(Base=PlaneXY(0, 0, 0), X=dom_4, Y=dom_4, Z=multiplication_11)
merge_13 = Merge(Data1=cap_2, Data2=box_3)
flatten_7 = FlattenTree(Tree=merge_13, Path="{0}")
move_15 = Move(Geometry=flatten_7, Motion=Z_4)  # -> Geometry, Transform
entwine_4 = Entwine(Branch00=move_14.Geometry, Branch01=move_15.Geometry, FlattenInputs=True)

# ---- group: 选单体
板埋or槽埋or板槽埋 = StreamFilter(Gate=list, Stream0=entwine_4, Stream1=entwine_2, Stream2=entwine_3)

# ----
# 三视图
# hidden lines of top+pers view
# move to center
# 如果无法完整的生成埋件的三视图，
# 建议选择埋件的3D在Rhino中将
# Top/Perspective/Front/Right 试图缩放至合适大小后重新运行
panel_34 = Panel("""Top
Perspective
Front
Right""")
m2d_rhino = Make2DRhinoView(Name=panel_34, Clip=True)
make2d = Make2D(Geometry=板埋or槽埋or板槽埋, View=m2d_rhino, TangentEdges=False, TangentSeams=False, AutoComputeMake2D=False)  # -> VisibleCurves, VisibleIndex, VisibleType, HiddenCurves, HiddenIndex, HiddenType
bang_2 = ExplodeTree(Data=make2d.VisibleCurves)  # -> Branch0, Branch1, Branch2, Branch3, Branch4, Branch5, Branch6, Branch7
bang_3 = ExplodeTree(Data=make2d.VisibleCurves)  # -> Branch0, Branch1, Branch2, Branch3, Branch4, Branch5, Branch6, Branch7
divdist = DivideDistance(Curve=make2d.HiddenCurves, Distance=Slider(1, range=0..10))  # -> Points, Tangents, Parameters
graft_2 = GraftTree(Tree=make2d.HiddenCurves, IncludeEmptyLists=True, IncludeNullItems=True)
shatter = Shatter(Curve=graft_2, Parameters=divdist.Parameters)
dispatch_20 = Dispatch(List=shatter, DispatchPattern=[True, False])  # -> ListA, ListB
crv_46 = Curve(dispatch_20.ListA)
pshift = ShiftPaths(Data=crv_46, Offset=-1)
pshift_2 = ShiftPaths(Data=pshift, Offset=-1)
bang_4 = ExplodeTree(Data=pshift_2)  # -> Branch0, Branch1, Branch2, Branch3, Branch4, Branch5, Branch6, Branch7
bang_5 = ExplodeTree(Data=pshift_2)  # -> Branch0, Branch1, Branch2, Branch3, Branch4, Branch5, Branch6, Branch7
entwine_5 = Entwine(Branch00=bang_5.Branch4, Branch01=bang_3.Branch4, FlattenInputs=True)  # -> flatten(Result)
entwine_6 = Entwine(Branch00=bang_5.Branch5, Branch01=bang_3.Branch5, FlattenInputs=True)  # -> flatten(Result)
entwine_7 = Entwine(Branch00=bang_4.Branch0, Branch01=bang_2.Branch0, FlattenInputs=True)  # -> flatten(Result)
entwine_8 = Entwine(Branch00=bang_4.Branch1, Branch01=bang_2.Branch1, FlattenInputs=True)  # -> flatten(Result)
entwine_9 = Entwine(Branch00=entwine_7, Branch01=entwine_8, Branch02=bang_2.Branch2, Branch03=bang_2.Branch3, FlattenInputs=True)
entwine_10 = Entwine(Branch00=entwine_5, Branch01=entwine_6, Branch02=bang_3.Branch6, Branch03=bang_3.Branch7, FlattenInputs=True)
group = Group(Objects=entwine_9)
group_2 = Group(Objects=entwine_10)
entwine_11 = Entwine(Branch00=group, Branch01=group_2, FlattenInputs=True)
pshift_3 = ShiftPaths(Data=entwine_11, Offset=-1)
pshift_4 = ShiftPaths(Data=entwine_11, Offset=-1)
number_slider_22 = Slider(2, range=0..10)
boxprop = BoxProperties(Box=pshift_3)  # -> Center, Diagonal, Area, Volume, Degeneracy
pt_28 = Point(Point(957.9296072, 367.7685097, 0))
pt_29 = Point("0,0,0")
recgrid_3 = Rectangular(
    Plane=pt_28,
    SizeX=Slider(12, range=1..20, expression="X*50"),
    SizeY=Slider(10, range=1..20, expression="X*50"),
    ExtentX=number_slider_22,
    ExtentY=number_slider_22)  # -> Cells, Points
vec2pt = Vector2Pt(PointA=boxprop.Center, PointB=pt_29, Unitize=False)  # -> Vector, Length
flatten_8 = FlattenTree(Tree=recgrid_3.Points, Path="{0}")
move_16 = Move(Geometry=pshift_4, Motion=vec2pt.Vector)  # -> flatten(Geometry), Transform
orient_5 = Orient(Geometry=flatten(move_16.Geometry), Source=PlaneXY(0, 0, 0), Target=flatten_8)  # -> Geometry, Transform
cull_i_6 = CullIndex(List=orient_5.Geometry, Indices="-1", Wrap=True)
split = SplitList(List=cull_i_6, Index="4")  # -> ListA, ListB
data_32 = Data(split.ListA)
data_33 = Data(split.ListB)
entwine_12 = Entwine(Branch00=data_32, Branch01=data_33, FlattenInputs=True)
geo_4 = Geometry(entwine_12)

# ---- group: 单体定Top/Side
item_21 = ListItem(List=geo_4, Index=2, Wrap=True)
item_22 = ListItem(List=geo_4, Index=Slider(0, range=0..10), Wrap=True)
cluster = Cluster(G=item_22)
cluster_2 = Cluster(G=item_21)

# ---- group: 单体定Top/Side / Top/Side
filter_15 = StreamFilter(Gate=list_2, Stream0=cluster, Stream1=cluster_2)

# ---- group: 单体定Top/Side / Monomer + Top/Side
filter_16 = StreamFilter(Gate=list, Stream0=filter_15, Stream1=filter_15, Stream2=filter_15)  # -> flatten(Stream)

# ---- group: Block
# 自定义块所在图层
# 自定义块所在图层颜色
# 自定义块名称
panel_35 = Panel("Embeded::Embeded")
layer_2 = DefineLayer(Name=panel_35, Color=ColourSwatch(SwatchColor=RGB(255, 0, 0)))
attributes = DefineObjectAttributes(Layer=layer_2)
block = DefineBlock(Geometry=filter_15, Attributes=attributes, BlockName="Steel Plate", BasePlane=PlaneXY(0, 0, 0))

# ---- group: 正常+阳角+阴角区分
cull_i_7 = CullIndex(List=item_2, Indices=cp.CPIndex, Wrap=True)
crv_47 = Curve(offset)
crv_48 = Curve(flip.Curve)
explode_5 = Explode(Curve=crv_47, Recursive=True)  # -> Segments, Vertices
explode_6 = Explode(Curve=crv_48, Recursive=True)  # -> Segments, Vertices

# ---- group: 阴角定位-细化
item_23 = ListItem(List=item, Index=cp.CPIndex, Wrap=True)

# ----
clscrv = CloseCurve(Curve=crv_16, CloseType=0, Bulge=0.5, Tolerance=0)  # -> Closed, R
# 第一层
# 
# Block(location point) + Smooth Curves(architecture line)
# For Correct Plane
# 求主体曲线转折点
crv_49 = Curve(crv_13)
disc_5 = Discontinuity(Curve=graft(crv_49), Level=1)  # -> Points, Parameters
crv_cp_4 = CurveClosestPoint(Point=disc_5.Points, Curve=graft(crv_49))  # -> Point, Parameter, Distance
eval_4 = EvaluateCurve(Curve=graft(crv_49), Parameter=crv_cp_4.Parameter)  # -> flatten(Point), Tangent, flatten(Angle)
deg_3 = Degrees(Radians=eval_4.Angle)
offset_6 = OffsetCurve(Curve=clscrv.Closed, Distance=expr("-X", Slider(300, range=0..1000)), Corners=1)
panel_36 = Panel(deg_3)
larger_5 = LargerThan(FirstNumber=deg_3, SecondNumber=Slider(60, range=0..100))  # -> LargerThan, OrEqualTo
disc_6 = Discontinuity(Curve=offset_6, Level=1)  # -> flatten(Points), Parameters
dispatch_21 = Dispatch(List=eval_4.Point, DispatchPattern=larger_5.LargerThan)  # -> ListA, ListB
data_34 = Data(dispatch_21.ListA)
pull_6 = PullPoint(Point=data_34, Geometry=flatten(offset_6), ClosestOnly=True)  # -> ClosestPoint, Distance
pull_7 = PullPoint(Point=flatten(pln_6), Geometry=crv_49, ClosestOnly=True)  # -> ClosestPoint, Distance
testpoint_2 = TestPoint(archPoint=pull_6.ClosestPoint, crvPoint=disc_6.Points)  # -> out, specialPt; inputs archPoint: list of Point3d, crvPoint: list of Point3d; same code as testpoint
pull_8 = PullPoint(Point=pull_7.ClosestPoint, Geometry=data_34, ClosestOnly=True)  # -> ClosestPoint, Distance
# 找阴阳角所在corners
flatten_9 = FlattenTree(Tree=data_26, Path="{0}")
sort_7 = SortList(Keys=pull_8.Distance, ValuesA=flatten_9)  # -> Keys, ValuesA
panel_37 = Panel(sort_7.Keys)
smaller_4 = SmallerThan(FirstNumber=sort_7.Keys, SecondNumber=Slider(100, range=0..100))  # -> SmallerThan, OrEqualTo
dispatch_22 = Dispatch(List=sort_7.ValuesA, DispatchPattern=smaller_4.SmallerThan)  # -> ListA, ListB
data_35 = Data(dispatch_22.ListA)
deblock_6 = DeconstructBlock(Block=data_35)  # -> Name, Plane, Geometry
deplane_10 = DeconstructPlane(Plane=deblock_6.Plane)  # -> Origin, XAxis, YAxis, ZAxis
pt_30 = Point(data_34)
pull_9 = PullPoint(Point=deplane_10.Origin, Geometry=pt_30, ClosestOnly=True)  # -> ClosestPoint, Distance
cir = Circle(Plane=pull_9.ClosestPoint, Radius=Slider(300, range=0..1000))
crv_50 = Curve(crv_49)
amp_6 = Amplitude(Vector=deplane_10.YAxis, Amplitude=Slider(200, range=0..1000))
ccx_7 = CurveCurve(CurveA=cir, CurveB=crv_50)  # -> Points, ParamsA, ParamsB
move_17 = Move(Geometry=pull_9.ClosestPoint, Motion=amp_6)  # -> Geometry, Transform
item_24 = ListItem(List=ccx_7.Points, Index=0, Wrap=True)
clean = CleanTree(RemoveNulls=True, RemoveInvalid=True, RemoveEmpty=Toggle(True), Tree=item_24)
ln_10 = Line(StartPoint=pull_9.ClosestPoint, EndPoint=clean)
ln_11 = Line(StartPoint=pull_9.ClosestPoint, EndPoint=move_17.Geometry)
angle_2 = Angle(VectorA=ln_11, VectorB=ln_10)  # -> Angle, Reflex
deg_4 = Degrees(Radians=angle_2.Angle)
flatten_10 = FlattenTree(Tree=deg_4, Path="{0}")
panel_38 = Panel(flatten_10)
c_script = CSharpScript(angle=flatten_10, minus=Slider(80, range=0..100))  # -> out, results; inputs angle: list of Double, minus: Double
# ---------- c_script: C# ----------
    List<double> MyAngle = new List<double>();
    for(int i = 0; i < angle.Count; i++){
      if (angle[i] > minus){
        angleEach = angle[i] - 90;
        Print("!!!!!!!!");
        MyAngle.Add(angleEach);
      }
      else{
        angleEach = angle[i];
        Print("00000");
        MyAngle.Add(angleEach);
      }

    }

    results = MyAngle;
# ---------- c_script: C# additional code ----------
  double angleEach = 0;
# ---------- end c_script ----------
larger_6 = LargerThan(FirstNumber=c_script.results, SecondNumber=Slider(30, range=0..100))  # -> LargerThan, OrEqualTo
panel_39 = Panel(c_script.results)
dispatch_23 = Dispatch(List=flatten(data_35), DispatchPattern=flatten(larger_6.LargerThan))  # -> ListA, ListB
data_36 = Data(dispatch_23.ListA)
# remove duplicate block and reconstruct plane
deblock_7 = DeconstructBlock(Block=data_36)  # -> Name, Plane, Geometry
pln_13 = Plane(flatten(pln_6))
deplane_11 = DeconstructPlane(Plane=flatten(deblock_7.Plane))  # -> Origin, XAxis, YAxis, ZAxis
deplane_12 = DeconstructPlane(Plane=pln_13)  # -> Origin, XAxis, YAxis, ZAxis
# Rhino 文件中导入的块名
testpoint_3 = TestPoint(archPoint=deplane_12.Origin, crvPoint=deplane_11.Origin)  # -> out, specialPt; inputs archPoint: list of Point3d, crvPoint: list of Point3d; same code as testpoint
cull_i_8 = CullIndex(List=pln_13, Indices=testpoint_3.specialPt, Wrap=True)
pln_14 = Plane(deblock_7.Plane)
crv_51 = Curve(crv_13)
pln_15 = Plane(cull_i_8)
data_37 = Data(flatten(pln_15))
deplane_13 = DeconstructPlane(Plane=data_37)  # -> Origin, XAxis, YAxis, ZAxis
amp_7 = Amplitude(Vector=deplane_13.YAxis, Amplitude=Slider(300, range=0..1000))
move_18 = Move(Geometry=deplane_13.Origin, Motion=amp_7)  # -> Geometry, Transform
ln_12 = Line(StartPoint=deplane_13.Origin, EndPoint=move_18.Geometry)
midpt_11 = CurveMiddle(Curve=ln_12)
scale_6 = Scale(Geometry=ln_12, Center=midpt_11, Factor=Slider(4.7, range=0..10))  # -> Geometry, Transform
ccx_8 = CurveCurve(CurveA=graft(scale_6.Geometry), CurveB=crv_51)  # -> flatten(Points), ParamsA, ParamsB
move2pt_6 = MoveToPoint(Geometry=data_37, PointA=deplane_13.Origin, PointB=ccx_8.Points)  # -> Moved, Vector, Transform

# ----
# 第一层
# 
# Angular Curves(architecture line)
number_slider_23 = Slider(84, range=0..1000)
crv_52 = Curve(crv_17)
crv_53 = Curve(clscrv.Closed)
offset_7 = OffsetCurve(Curve=crv_53, Distance=expr("-x", number_slider_23), Corners=1)  # -> flatten(Curve)
disc_7 = Discontinuity(Curve=crv_52, Level=1)  # -> Points, Parameters
pull_10 = PullPoint(Point=disc_7.Points, Geometry=offset_7, ClosestOnly=True)  # -> ClosestPoint, Distance
# 转角点
disc_8 = Discontinuity(Curve=offset_7, Level=1)  # -> Points, Parameters
pull_11 = PullPoint(Point=flatten(pull_10.ClosestPoint), Geometry=flatten(disc_8.Points), ClosestOnly=True)  # -> ClosestPoint, Distance
check_same_points = CheckSamePoints(archPoint=flatten(pull_10.ClosestPoint), crvPoint=flatten(pull_11.ClosestPoint))  # -> out, specialPt; inputs archPoint: list of Point3d, crvPoint: list of Point3d; same code as testpoint
cull_i_9 = CullIndex(List=flatten(disc_7.Points), Indices=check_same_points.specialPt, Wrap=True)
end_5 = EndPoints(Curve=crv_52)  # -> Start, End
merge_14 = Merge(Data1=end_5.Start, Data2=end_5.End, Data3=cull_i_9)
flatten_11 = FlattenTree(Tree=disc_7.Points, Path="{0}")
check_same_points_2 = CheckSamePoints(archPoint=flatten(flatten_11), crvPoint=flatten(merge_14))  # -> out, specialPt; inputs archPoint: list of Point3d, crvPoint: list of Point3d; same code as testpoint
cull_i_10 = CullIndex(List=flatten(flatten_11), Indices=check_same_points_2.specialPt, Wrap=True)
pull_12 = PullPoint(Point=cull_i_10, Geometry=offset_7, ClosestOnly=True)  # -> ClosestPoint, Distance
ln_13 = Line(StartPoint=cull_i_10, EndPoint=pull_12.ClosestPoint)
rotate_5 = Rotate(Geometry=ln_13, Angle="Pi", Plane=cull_i_10)  # -> Geometry, Transform
# 阳角
# 阴角
# 阳角
# 阴角
rotate_6 = Rotate(Geometry=ln_13, Angle=1.570796327, Plane=cull_i_10)  # -> Geometry, Transform
# SmoothCurve-正常
# SmoothCurve-阳角
# SmoothCurve-阴角
# SmoothCurve-正常
# SmoothCurve-阳角
# SmoothCurve-阴角
# SmoothCurve-阳角
# SmoothCurve-阴角
# SmoothCurve-正常
# Angular Curve - All
# Special Curve(with location)- All
# Curve for this project only - All
pl_4 = ConstructPlane(Origin=cull_i_10, XAxis=rotate_5.Geometry, YAxis=rotate_6.Geometry)

# ----
# 第一层
# 
# Angular Curves(architecture line)
crv_54 = Curve(crv_15)
crv_55 = Curve(clscrv.Closed)
offset_8 = OffsetCurve(Curve=crv_55, Distance=expr("-x", Slider(84, range=0..1000)), Corners=1)  # -> flatten(Curve)
disc_9 = Discontinuity(Curve=crv_54, Level=1)  # -> Points, Parameters
pull_13 = PullPoint(Point=disc_9.Points, Geometry=offset_8, ClosestOnly=True)  # -> ClosestPoint, Distance
disc_10 = Discontinuity(Curve=offset_8, Level=1)  # -> Points, Parameters
pull_14 = PullPoint(Point=flatten(pull_13.ClosestPoint), Geometry=flatten(disc_10.Points), ClosestOnly=True)  # -> ClosestPoint, Distance
check_same_points_3 = CheckSamePoints(archPoint=flatten(pull_13.ClosestPoint), crvPoint=flatten(pull_14.ClosestPoint))  # -> out, specialPt; inputs archPoint: list of Point3d, crvPoint: list of Point3d; same code as testpoint
cull_i_11 = CullIndex(List=flatten(disc_9.Points), Indices=check_same_points_3.specialPt, Wrap=True)
end_6 = EndPoints(Curve=crv_54)  # -> Start, End
merge_15 = Merge(Data1=end_6.Start, Data2=end_6.End, Data3=cull_i_11)
flatten_12 = FlattenTree(Tree=disc_9.Points, Path="{0}")
check_same_points_4 = CheckSamePoints(archPoint=flatten(flatten_12), crvPoint=flatten(merge_15))  # -> out, specialPt; inputs archPoint: list of Point3d, crvPoint: list of Point3d; same code as testpoint
cull_i_12 = CullIndex(List=flatten(flatten_12), Indices=check_same_points_4.specialPt, Wrap=True)
pull_15 = PullPoint(Point=cull_i_12, Geometry=offset_8, ClosestOnly=True)  # -> ClosestPoint, Distance
ln_14 = Line(StartPoint=cull_i_12, EndPoint=pull_15.ClosestPoint)
rotate_7 = Rotate(Geometry=ln_14, Angle="Pi", Plane=cull_i_12)  # -> Geometry, Transform
rotate_8 = Rotate(Geometry=rotate_7.Geometry, Angle=-1.570796327, Plane=cull_i_12)  # -> Geometry, Transform
pl_5 = ConstructPlane(Origin=cull_i_12, XAxis=rotate_7.Geometry, YAxis=rotate_8.Geometry)

# ----
# SmoothCurve-阴角&阳角
# 阳角
item_25 = ListItem(List=data_34, Index=testpoint_2.specialPt, Wrap=True)

# ----
# 第一层
# 
# Curves(location point)+ Smooth Curves(architecture line)
# remove duplicate curves
geo_5 = Geometry(project_3.Geometry)
boundary_4 = BoundarySurfaces(Edges=geo_5)
area_10 = Area(Geometry=boundary_4)  # -> Area, Centroid
cullduppoints_4 = RemoveDuplicatePoints(InputPoints=area_10.Centroid, Tolerance=Slider(0.1, range=0..0.1))  # -> OutputPoints, FirstPointIndexes
null_8 = NullItem(Item=cullduppoints_4.FirstPointIndexes)  # -> NullFlags, InvalidFlags, Description
dispatch_24 = Dispatch(List=boundary_4, DispatchPattern=null_8.NullFlags)  # -> ListA, ListB
geo_6 = Geometry(dispatch_24.ListA)
crv_56 = Curve(crv_13)
area_11 = Area(Geometry=geo_6)  # -> Area, Centroid
pull_16 = PullPoint(Point=area_11.Centroid, Geometry=crv_56, ClosestOnly=True)  # -> ClosestPoint, Distance
dist_3 = Distance(PointA=pull_16.ClosestPoint, PointB=data_34)
sort_8 = SortList(Keys=dist_3)  # -> Keys, ValuesA
panel_40 = Panel(sort_8.Keys)
smaller_5 = SmallerThan(FirstNumber=dist_3, SecondNumber=Slider(200, range=0..1000))  # -> SmallerThan, OrEqualTo
dispatch_25 = Dispatch(List=geo_6, DispatchPattern=smaller_5.SmallerThan)  # -> ListA, ListB
# 第二层-阴阳角
# 第二层-大面定位
data_38 = Data(dispatch_25.ListA)
data_39 = Data(dispatch_25.ListB)
explode_7 = Explode(Curve=data_38, Recursive=True)  # -> Segments, Vertices
explode_8 = Explode(Curve=data_39, Recursive=True)  # -> Segments, Vertices
len_4 = Length(Curve=explode_7.Segments)
len_5 = Length(Curve=explode_8.Segments)
sort_9 = SortList(Keys=reverse(len_4), ValuesA=explode_7.Segments)  # -> Keys, ValuesA
sort_10 = SortList(Keys=reverse(len_5), ValuesA=explode_8.Segments)  # -> Keys, ValuesA
item_26 = ListItem(List=sort_9.ValuesA, Index=0, Wrap=True)  # -> flatten(Item)
area_12 = Area(Geometry=data_38)  # -> Area, Centroid
item_27 = ListItem(List=sort_10.ValuesA, Index=0, Wrap=True)  # -> flatten(Item)
area_13 = Area(Geometry=data_39)  # -> Area, Centroid
midpt_12 = CurveMiddle(Curve=item_26)
midpt_13 = CurveMiddle(Curve=item_27)
move2pt_7 = MoveToPoint(Geometry=item_26, PointA=midpt_12, PointB=area_12.Centroid)  # -> Moved, Vector, Transform
move2pt_8 = MoveToPoint(Geometry=item_27, PointA=midpt_13, PointB=area_13.Centroid)  # -> Moved, Vector, Transform
end_7 = EndPoints(Curve=move2pt_7.Moved)  # -> Start, End
end_8 = EndPoints(Curve=move2pt_8.Moved)  # -> Start, End
ln_15 = Line(StartPoint=end_7.Start, EndPoint=end_7.End)
pull_17 = PullPoint(Point=end_8.Start, Geometry=crv_56, ClosestOnly=True)  # -> ClosestPoint, Distance
neg_4 = Negative(Value="0.5 * Pi")
neg_5 = Negative(Value="1.5 * Pi")
crv_cp_5 = CurveClosestPoint(Point=graft(pull_17.ClosestPoint), Curve=crv_56)  # -> Point, Parameter, Distance
filter_17 = StreamFilter(Gate=Toggle(True), Stream0="0.5 * Pi", Stream1=neg_4)
filter_18 = StreamFilter(Gate=Toggle(True), Stream0="1.5 * Pi", Stream1=neg_5)
xy_25 = XYPlane(Origin=end_7.End)
eval_5 = EvaluateCurve(Curve=crv_56, Parameter=crv_cp_5.Parameter)  # -> Point, Tangent, Angle
rotate_9 = Rotate(Geometry=ln_15, Angle=filter_17, Plane=xy_25)  # -> Geometry, Transform
pull_18 = PullPoint(Point=eval_5.Point, Geometry=pull_17.ClosestPoint, ClosestOnly=True)  # -> ClosestPoint, Distance
pl_6 = ConstructPlane(Origin=end_7.End, XAxis=rotate_9.Geometry, YAxis=ln_15)
sort_11 = SortList(Keys=pull_18.Distance, ValuesA=eval_5.Point)  # -> Keys, ValuesA
sort_12 = SortList(Keys=pull_18.Distance, ValuesA=eval_5.Tangent)  # -> Keys, ValuesA
dist_4 = Distance(PointA=graft(end_7.End), PointB=item_25)
item_28 = ListItem(List=sort_12.ValuesA, Index="0", Wrap=True)
sort_13 = SortList(Keys=dist_4)  # -> Keys, ValuesA
item_29 = ListItem(List=sort_11.ValuesA, Index="0", Wrap=True)
item_30 = ListItem(List=sort_13.Keys, Index=0, Wrap=True)
smaller_6 = SmallerThan(FirstNumber=item_30, SecondNumber=Slider(100, range=0..300))  # -> SmallerThan, OrEqualTo
flatten_13 = FlattenTree(Tree=item_30, Path="{0}")
amp_8 = Amplitude(Vector=item_28, Amplitude=Slider(100, range=0..100))
dispatch_26 = Dispatch(List=graft(pl_6), DispatchPattern=smaller_6.SmallerThan)  # -> ListA, ListB
panel_41 = Panel(flatten_13)
move_19 = Move(Geometry=item_29, Motion=amp_8)  # -> Geometry, Transform
xy_26 = XYPlane(Origin=item_29)
rotate_10 = Rotate(Geometry=move_19.Geometry, Angle="1 * Pi", Plane=xy_26)  # -> Geometry, Transform
ln_16 = Line(StartPoint=item_29, EndPoint=rotate_10.Geometry)
crv_57 = Curve(crv_13)
rotate_11 = Rotate(Geometry=ln_16, Angle=filter_18, Plane=xy_26)  # -> Geometry, Transform
data_40 = Data(flatten(dispatch_26.ListA))
data_41 = Data(flatten(dispatch_26.ListB))
deplane_14 = DeconstructPlane(Plane=data_40)  # -> Origin, XAxis, YAxis, ZAxis
deplane_15 = DeconstructPlane(Plane=data_41)  # -> Origin, XAxis, YAxis, ZAxis
amp_9 = Amplitude(Vector=deplane_14.YAxis, Amplitude=Slider(300, range=0..1000))
amp_10 = Amplitude(Vector=deplane_15.YAxis, Amplitude=Slider(300, range=0..1000))
move_20 = Move(Geometry=deplane_14.Origin, Motion=amp_9)  # -> Geometry, Transform
move_21 = Move(Geometry=deplane_15.Origin, Motion=amp_10)  # -> Geometry, Transform
ln_17 = Line(StartPoint=deplane_14.Origin, EndPoint=move_20.Geometry)
ln_18 = Line(StartPoint=deplane_15.Origin, EndPoint=move_21.Geometry)
midpt_14 = CurveMiddle(Curve=ln_17)
midpt_15 = CurveMiddle(Curve=ln_18)
scale_7 = Scale(Geometry=ln_17, Center=midpt_14, Factor=Slider(1.5, range=0..10))  # -> Geometry, Transform
scale_8 = Scale(Geometry=ln_18, Center=midpt_15, Factor=Slider(1.5, range=0..10))  # -> Geometry, Transform
ccx_9 = CurveCurve(CurveA=graft(scale_8.Geometry), CurveB=crv_57)  # -> flatten(Points), ParamsA, ParamsB
ccx_10 = CurveCurve(CurveA=graft(scale_7.Geometry), CurveB=crv_57)  # -> flatten(Points), ParamsA, ParamsB
move2pt_9 = MoveToPoint(Geometry=data_40, PointA=deplane_14.Origin, PointB=ccx_10.Points)  # -> Moved, Vector, Transform
move2pt_10 = MoveToPoint(Geometry=data_41, PointA=deplane_15.Origin, PointB=ccx_9.Points)  # -> Moved, Vector, Transform
pl_7 = ConstructPlane(Origin=move_19.Geometry, XAxis=ln_16, YAxis=rotate_11.Geometry)

# ----
# 阴角
cull_i_13 = CullIndex(List=data_34, Indices=testpoint_2.specialPt, Wrap=True)

dist_5 = Distance(PointA=graft(deplane_11.Origin), PointB=item_25)
sort_14 = SortList(Keys=dist_5)  # -> Keys, ValuesA
item_31 = ListItem(List=sort_14.Keys, Index=0, Wrap=True)
flatten_14 = FlattenTree(Tree=item_31, Path="{0}")
smaller_7 = SmallerThan(FirstNumber=item_31, SecondNumber=Slider(100, range=0..300))  # -> SmallerThan, OrEqualTo
panel_42 = Panel(flatten_14)
dispatch_27 = Dispatch(List=graft(pln_14), DispatchPattern=smaller_7.SmallerThan)  # -> ListA, ListB
data_42 = Data(flatten(dispatch_27.ListA))
data_43 = Data(flatten(dispatch_27.ListB))
deplane_16 = DeconstructPlane(Plane=data_42)  # -> Origin, XAxis, YAxis, ZAxis
deplane_17 = DeconstructPlane(Plane=data_43)  # -> Origin, XAxis, YAxis, ZAxis
amp_11 = Amplitude(Vector=deplane_16.YAxis, Amplitude=Slider(300, range=0..1000))
amp_12 = Amplitude(Vector=deplane_17.YAxis, Amplitude=Slider(300, range=0..1000))
move_22 = Move(Geometry=deplane_16.Origin, Motion=amp_11)  # -> Geometry, Transform
move_23 = Move(Geometry=deplane_17.Origin, Motion=amp_12)  # -> Geometry, Transform
ln_19 = Line(StartPoint=deplane_16.Origin, EndPoint=move_22.Geometry)
ln_20 = Line(StartPoint=deplane_17.Origin, EndPoint=move_23.Geometry)
midpt_16 = CurveMiddle(Curve=ln_19)
midpt_17 = CurveMiddle(Curve=ln_20)
scale_9 = Scale(Geometry=ln_19, Center=midpt_16, Factor=Slider(1.5, range=0..10))  # -> Geometry, Transform
scale_10 = Scale(Geometry=ln_20, Center=midpt_17, Factor=Slider(1.5, range=0..10))  # -> Geometry, Transform
ccx_11 = CurveCurve(CurveA=graft(scale_9.Geometry), CurveB=crv_51)  # -> flatten(Points), ParamsA, ParamsB
ccx_12 = CurveCurve(CurveA=graft(scale_10.Geometry), CurveB=crv_51)  # -> flatten(Points), ParamsA, ParamsB
move2pt_11 = MoveToPoint(Geometry=data_42, PointA=deplane_16.Origin, PointB=ccx_11.Points)  # -> Moved, Vector, Transform
move2pt_12 = MoveToPoint(Geometry=data_43, PointA=deplane_17.Origin, PointB=ccx_12.Points)  # -> Moved, Vector, Transform

clscrv_2 = CloseCurve(Curve=crv_16, CloseType=0, Bulge=0.5, Tolerance=0)  # -> Closed, R
# 第一层
# 
# Block(location point) + Smooth Curves(architecture line)
# 
# For Wrong Plane
crv_58 = Curve(crv_13)
disc_11 = Discontinuity(Curve=graft(crv_58), Level=1)  # -> Points, Parameters
crv_cp_6 = CurveClosestPoint(Point=disc_11.Points, Curve=graft(crv_58))  # -> Point, Parameter, Distance
eval_6 = EvaluateCurve(Curve=graft(crv_58), Parameter=crv_cp_6.Parameter)  # -> flatten(Point), Tangent, flatten(Angle)
deg_5 = Degrees(Radians=eval_6.Angle)
offset_9 = OffsetCurve(Curve=clscrv_2.Closed, Distance=expr("-X", Slider(300, range=0..1000)), Corners=1)
panel_43 = Panel(deg_5)
larger_7 = LargerThan(FirstNumber=deg_5, SecondNumber=Slider(60, range=0..100))  # -> LargerThan, OrEqualTo
disc_12 = Discontinuity(Curve=offset_9, Level=1)  # -> flatten(Points), Parameters
dispatch_28 = Dispatch(List=eval_6.Point, DispatchPattern=larger_7.LargerThan)  # -> ListA, ListB
data_44 = Data(dispatch_28.ListA)
pull_19 = PullPoint(Point=data_44, Geometry=flatten(offset_9), ClosestOnly=True)  # -> ClosestPoint, Distance
testpoint_4 = TestPoint(archPoint=pull_19.ClosestPoint, crvPoint=disc_12.Points)  # -> out, specialPt; inputs archPoint: list of Point3d, crvPoint: list of Point3d; same code as testpoint
pull_20 = PullPoint(Point=flatten(pln_12), Geometry=crv_58, ClosestOnly=True)  # -> ClosestPoint, Distance
pull_21 = PullPoint(Point=pull_20.ClosestPoint, Geometry=data_44, ClosestOnly=True)  # -> ClosestPoint, Distance
# 找阴阳角所在corners
flatten_15 = FlattenTree(Tree=data_31, Path="{0}")
sort_15 = SortList(Keys=pull_21.Distance, ValuesA=flatten_15)  # -> Keys, ValuesA
panel_44 = Panel(sort_15.Keys)
smaller_8 = SmallerThan(FirstNumber=sort_15.Keys, SecondNumber=Slider(100, range=0..100))  # -> SmallerThan, OrEqualTo
dispatch_29 = Dispatch(List=sort_15.ValuesA, DispatchPattern=smaller_8.SmallerThan)  # -> ListA, ListB
data_45 = Data(dispatch_29.ListA)
deblock_8 = DeconstructBlock(Block=data_45)  # -> Name, Plane, Geometry
deplane_18 = DeconstructPlane(Plane=deblock_8.Plane)  # -> Origin, XAxis, YAxis, ZAxis
pt_31 = Point(data_44)
pull_22 = PullPoint(Point=deplane_18.Origin, Geometry=pt_31, ClosestOnly=True)  # -> ClosestPoint, Distance
cir_2 = Circle(Plane=pull_22.ClosestPoint, Radius=Slider(300, range=0..1000))
crv_59 = Curve(crv_58)
amp_13 = Amplitude(Vector=deplane_18.YAxis, Amplitude=Slider(200, range=0..1000))
ccx_13 = CurveCurve(CurveA=cir_2, CurveB=crv_59)  # -> Points, ParamsA, ParamsB
move_24 = Move(Geometry=pull_22.ClosestPoint, Motion=amp_13)  # -> Geometry, Transform
item_32 = ListItem(List=ccx_13.Points, Index=0, Wrap=True)
clean_2 = CleanTree(RemoveNulls=True, RemoveInvalid=True, RemoveEmpty=Toggle(True), Tree=item_32)
# SmoothCurve-阴角&阳角
item_33 = ListItem(List=data_44, Index=testpoint_4.specialPt, Wrap=True)
cull_i_14 = CullIndex(List=data_44, Indices=testpoint_4.specialPt, Wrap=True)
ln_21 = Line(StartPoint=pull_22.ClosestPoint, EndPoint=clean_2)
ln_22 = Line(StartPoint=pull_22.ClosestPoint, EndPoint=move_24.Geometry)
angle_3 = Angle(VectorA=ln_22, VectorB=ln_21)  # -> Angle, Reflex
deg_6 = Degrees(Radians=angle_3.Angle)
flatten_16 = FlattenTree(Tree=deg_6, Path="{0}")
panel_45 = Panel(flatten_16)
c_script_2 = CSharpScript(angle=flatten_16, minus=Slider(80, range=0..100))  # -> out, results; inputs angle: list of Double, minus: Double; same code as c_script
larger_8 = LargerThan(FirstNumber=c_script_2.results, SecondNumber=Slider(30, range=0..100))  # -> LargerThan, OrEqualTo
panel_46 = Panel(c_script_2.results)
dispatch_30 = Dispatch(List=flatten(data_45), DispatchPattern=flatten(larger_8.LargerThan))  # -> ListA, ListB
data_46 = Data(dispatch_30.ListA)
# remove duplicate block and reconstruct plane
deblock_9 = DeconstructBlock(Block=data_46)  # -> Name, Plane, Geometry
pln_16 = Plane(flatten(pln_12))
deplane_19 = DeconstructPlane(Plane=flatten(deblock_9.Plane))  # -> Origin, XAxis, YAxis, ZAxis
deplane_20 = DeconstructPlane(Plane=pln_16)  # -> Origin, XAxis, YAxis, ZAxis
testpoint_5 = TestPoint(archPoint=deplane_20.Origin, crvPoint=deplane_19.Origin)  # -> out, specialPt; inputs archPoint: list of Point3d, crvPoint: list of Point3d; same code as testpoint
cull_i_15 = CullIndex(List=pln_16, Indices=testpoint_5.specialPt, Wrap=True)
pln_17 = Plane(deblock_9.Plane)
dist_6 = Distance(PointA=graft(deplane_19.Origin), PointB=item_33)
sort_16 = SortList(Keys=dist_6)  # -> Keys, ValuesA
item_34 = ListItem(List=sort_16.Keys, Index=0, Wrap=True)
flatten_17 = FlattenTree(Tree=item_34, Path="{0}")
smaller_9 = SmallerThan(FirstNumber=item_34, SecondNumber=Slider(100, range=0..300))  # -> SmallerThan, OrEqualTo
panel_47 = Panel(flatten_17)
dispatch_31 = Dispatch(List=graft(pln_17), DispatchPattern=smaller_9.SmallerThan)  # -> ListA, ListB
crv_60 = Curve(crv_13)
pln_18 = Plane(cull_i_15)

data_47 = Data(flatten(dispatch_31.ListA))
deplane_21 = DeconstructPlane(Plane=data_47)  # -> Origin, XAxis, YAxis, ZAxis
amp_14 = Amplitude(Vector=deplane_21.YAxis, Amplitude=Slider(300, range=0..1000))
move_25 = Move(Geometry=deplane_21.Origin, Motion=amp_14)  # -> Geometry, Transform
ln_23 = Line(StartPoint=deplane_21.Origin, EndPoint=move_25.Geometry)
midpt_18 = CurveMiddle(Curve=ln_23)
scale_11 = Scale(Geometry=ln_23, Center=midpt_18, Factor=Slider(1.5, range=0..10))  # -> Geometry, Transform
ccx_14 = CurveCurve(CurveA=graft(scale_11.Geometry), CurveB=crv_60)  # -> flatten(Points), ParamsA, ParamsB

data_48 = Data(flatten(dispatch_31.ListB))
deplane_22 = DeconstructPlane(Plane=data_48)  # -> Origin, XAxis, YAxis, ZAxis
amp_15 = Amplitude(Vector=deplane_22.YAxis, Amplitude=Slider(300, range=0..1000))
move_26 = Move(Geometry=deplane_22.Origin, Motion=amp_15)  # -> Geometry, Transform
ln_24 = Line(StartPoint=deplane_22.Origin, EndPoint=move_26.Geometry)
midpt_19 = CurveMiddle(Curve=ln_24)
scale_12 = Scale(Geometry=ln_24, Center=midpt_19, Factor=Slider(1.5, range=0..10))  # -> Geometry, Transform
ccx_15 = CurveCurve(CurveA=graft(scale_12.Geometry), CurveB=crv_60)  # -> flatten(Points), ParamsA, ParamsB

data_49 = Data(flatten(pln_18))
deplane_23 = DeconstructPlane(Plane=data_49)  # -> Origin, XAxis, YAxis, ZAxis
amp_16 = Amplitude(Vector=deplane_23.YAxis, Amplitude=Slider(300, range=0..1000))
move_27 = Move(Geometry=deplane_23.Origin, Motion=amp_16)  # -> Geometry, Transform
ln_25 = Line(StartPoint=deplane_23.Origin, EndPoint=move_27.Geometry)
midpt_20 = CurveMiddle(Curve=ln_25)
scale_13 = Scale(Geometry=ln_25, Center=midpt_20, Factor=Slider(4.7, range=0..10))  # -> Geometry, Transform
ccx_16 = CurveCurve(CurveA=graft(scale_13.Geometry), CurveB=crv_60)  # -> flatten(Points), ParamsA, ParamsB

move2pt_13 = MoveToPoint(Geometry=data_49, PointA=deplane_23.Origin, PointB=ccx_16.Points)  # -> Moved, Vector, Transform
move2pt_14 = MoveToPoint(Geometry=data_47, PointA=deplane_21.Origin, PointB=ccx_14.Points)  # -> Moved, Vector, Transform
move2pt_15 = MoveToPoint(Geometry=data_48, PointA=deplane_22.Origin, PointB=ccx_15.Points)  # -> Moved, Vector, Transform
xy_27 = XYPlane(Origin=move2pt_13.Moved)
xy_28 = XYPlane(Origin=move2pt_14.Moved)
xy_29 = XYPlane(Origin=move2pt_15.Moved)
rotate_12 = Rotate(Geometry=move2pt_13.Moved, Angle="Pi", Plane=xy_27)  # -> Geometry, Transform
rotate_13 = Rotate(Geometry=move2pt_14.Moved, Angle="Pi", Plane=xy_28)  # -> Geometry, Transform
rotate_14 = Rotate(Geometry=move2pt_15.Moved, Angle="Pi", Plane=xy_29)  # -> Geometry, Transform
filter_19 = StreamFilter(Gate=Toggle(True), Stream0=move2pt_13.Moved, Stream1=rotate_12.Geometry)
filter_20 = StreamFilter(Gate=Toggle(True), Stream0=move2pt_14.Moved, Stream1=rotate_13.Geometry)
filter_21 = StreamFilter(Gate=Toggle(True), Stream0=move2pt_15.Moved, Stream1=rotate_14.Geometry)

merge_16 = Merge(
    Data1=move2pt_6.Moved,
    Data2=move2pt_11.Moved,
    Data3=move2pt_12.Moved,
    Data4=filter_19,
    Data5=filter_20,
    Data6=filter_21,
    Data7=move2pt_9.Moved,
    Data8=move2pt_10.Moved,
    Data9=pl_7,
    Data10=pl_5,
    Data11=pl_3,
    Data12=pl_4)  # -> flatten(Result)

# ----
# 1.是否有檐口线
toggle_4 = BooleanToggle(True)
clean_3 = CleanTree(RemoveNulls=True, RemoveInvalid=True, RemoveEmpty=toggle_4, Tree=merge_16)
crv_61 = Curve(crv_12)
deplane_24 = DeconstructPlane(Plane=clean_3)  # -> Origin, XAxis, YAxis, ZAxis
incurve = PointInCurve(Point=deplane_24.Origin, Curve=crv_61)  # -> Relationship, Point
equals_3 = Equality(FirstNumber=incurve.Relationship, SecondNumber="2")  # -> Equality, Inequality
dispatch_32 = Dispatch(List=clean_3, DispatchPattern=equals_3.Equality)  # -> ListA, ListB

# ----
# 1.0无檐口线
pln_19 = Plane(dispatch_32.ListB)

# ----
# 1.1有檐口线
pln_20 = Plane(dispatch_32.ListA)

deplane_25 = DeconstructPlane(Plane=pln_19)  # -> Origin, XAxis, YAxis, ZAxis

# ----
# 1.1.1布埋件
pln_21 = Plane(pln_20)

incurve_2 = PointInCurve(Point=deplane_25.Origin, Curve=filter_8)  # -> Relationship, Point
equals_4 = Equality(FirstNumber=incurve_2.Relationship, SecondNumber="2")  # -> Equality, Inequality

# ----
# 0.有檐口-整个site一起处理
number_slider_24 = Slider(5000, range=0..10000)
deplane_26 = DeconstructPlane(Plane=pln_21)  # -> Origin, XAxis, YAxis, ZAxis
amp_17 = Amplitude(Vector=deplane_26.YAxis, Amplitude=number_slider_24)
move_28 = Move(Geometry=deplane_26.Origin, Motion=amp_17)  # -> Geometry, Transform
ln_26 = Line(StartPoint=deplane_26.Origin, EndPoint=move_28.Geometry)
ccx_17 = CurveCurve(CurveA=graft(ln_26), CurveB=flatten(merge_4))  # -> Points, ParamsA, ParamsB
shift = ShiftPaths(Data=ccx_17.Points, Offset=-1)
sort_17 = SortList(Keys=shift, ValuesA=shift)  # -> Keys, ValuesA
item_35 = ListItem(List=sort_17.ValuesA, Index="-1", Wrap=True)
null_9 = NullItem(Item=flatten(item_35))  # -> NullFlags, InvalidFlags, Description
dispatch_33 = Dispatch(List=pln_21, DispatchPattern=null_9.InvalidFlags)  # -> ListA, ListB
dispatch_34 = Dispatch(List=item_35, DispatchPattern=item_35)  # -> ListA, ListB
data_50 = Data(dispatch_33.ListB)
data_51 = Data(dispatch_34.ListA)
check_same_points_5 = CheckSamePoints(archPoint=pln_21, crvPoint=data_50)  # -> out, specialPt; inputs archPoint: list of Point3d, crvPoint: list of Point3d; same code as testpoint
deplane_27 = DeconstructPlane(Plane=data_50)  # -> Origin, XAxis, YAxis, ZAxis

dispatch_35 = Dispatch(List=pln_19, DispatchPattern=equals_4.Equality)  # -> ListA, ListB
data_52 = Data(dispatch_35.ListB)

# ----
# 0.檐口处侧埋，钢板焊
# 02：钢板焊埋件[钢梁外侧]
# @钢边梁宽@钢边梁高
move2pt_16 = MoveToPoint(Geometry=data_50, PointA=deplane_27.Origin, PointB=flatten(data_51))  # -> Moved, Vector, Transform

# ----
# 0.Missing Point
cull_i_16 = CullIndex(List=pln_21, Indices=check_same_points_5.specialPt, Wrap=True)

# ---- group: 大面
# 大面埋件布置
number_slider_25 = Slider(0.002, range=0..0.01)
filter_22 = StreamFilter(Gate=list_2, Stream0=expression_4, Stream1=number_slider_25)
filter_23 = StreamFilter(Gate=list, Stream0=filter_22, Stream1=expression_4, Stream2=filter_22)
offset_10 = OffsetCurve(Curve=offset, Distance=expr("-x", filter_23), Plane=PlaneXY(0, 0, 0), Corners=1)

# ---- group: 阴阳角区分 (continued)
crv_cp_7 = CurveClosestPoint(Point=item_16, Curve=offset_10)  # -> Point, Parameter, Distance
vec2pt_2 = Vector2Pt(PointA=crv_cp_7.Point, PointB=crv_cp_3.Point, Unitize=False)  # -> expr("-x", Vector), Length
angle_4 = Angle(VectorA=eval_3.Tangent, VectorB=vec2pt_2.Vector)  # -> Angle, Reflex
deg_7 = Degrees(Radians=angle_4.Angle)
smaller_10 = SmallerThan(FirstNumber=deg_7, SecondNumber=89)  # -> SmallerThan, OrEqualTo
dispatch_36 = Dispatch(List=item_16, DispatchPattern=smaller_10.SmallerThan)  # -> ListA, ListB

# ---- group: 正常+阳角+阴角区分 (continued)
data_53 = Data(dispatch_36.ListA)
data_54 = Data(dispatch_36.ListB)
pull_23 = PullPoint(Point=data_53, Geometry=crv_47, ClosestOnly=True)  # -> ClosestPoint, Distance
pull_24 = PullPoint(Point=data_54, Geometry=crv_48, ClosestOnly=True)  # -> ClosestPoint, Distance
c_script_3 = CSharpScript(archPoint=pull_23.ClosestPoint, crvPoint=explode_5.Vertices)  # -> out, specialPt; inputs archPoint: list of Point3d, crvPoint: list of Point3d; same code as testpoint
c_script_4 = CSharpScript(archPoint=pull_24.ClosestPoint, crvPoint=explode_6.Vertices)  # -> out, specialPt; inputs archPoint: list of Point3d, crvPoint: list of Point3d; same code as testpoint
cull_i_17 = CullIndex(List=data_53, Indices=c_script_3.specialPt, Wrap=True)

# ---- group: 阴角定位-细化 (continued)
dispatch_37 = Dispatch(List=item_23, DispatchPattern=smaller_10.SmallerThan)  # -> ListA, ListB
item_36 = ListItem(List=dispatch_37.ListB, Index=c_script_4.specialPt, Wrap=True)
join_4 = JoinCurves(Curves=item_36, Preserve=False)
explode_9 = Explode(Curve=join_4, Recursive=True)  # -> Segments, Vertices
crv_62 = Curve(simplify(explode_9.Segments))
len_6 = Length(Curve=crv_62)
sort_18 = SortList(Keys=len_6, ValuesA=crv_62)  # -> Keys, ValuesA
item_37 = ListItem(List=sort_18.ValuesA, Index=0, Wrap=True)  # -> Item2, Item1, Item
crv_63 = Curve([item_37.Item2, item_37.Item1])
disc_13 = Discontinuity(Curve=crv_63, Level=1)  # -> Points, Parameters
item_38 = ListItem(List=disc_13.Points, Index=0, Wrap=True)
pull_25 = PullPoint(Point=disc_13.Points, Geometry=pt_2, ClosestOnly=True)  # -> ClosestPoint, Distance
crv_cp_8 = CurveClosestPoint(Point=disc_13.Points, Curve=offset)  # -> Point, Parameter, Distance
sort_19 = SortList(Keys=pull_25.Distance, ValuesA=crv_cp_8.Point)  # -> Keys, ValuesA

# ---- group: 正常+阳角+阴角区分 / 正常-遗漏
cull_i_18 = CullIndex(List=data_54, Indices=c_script_4.specialPt, Wrap=True)

# ---- group: 正常+阳角+阴角区分 / 阴角定位点
item_39 = ListItem(List=data_54, Index=c_script_4.specialPt, Wrap=True)

# ---- group: 正常+阳角+阴角区分 / 正常定位点
merge_17 = Merge(Data1=cull_i_7, Data2=cull_i_18, Data3=cull_i_17)

# ---- group: 正常+阳角+阴角区分 / 阳角定位点
item_40 = ListItem(List=data_53, Index=c_script_3.specialPt, Wrap=True)

# ---- group: 阴角定位-细化 / 阴角-2点定位
item_41 = ListItem(List=sort_19.ValuesA, Index=0, Wrap=True)

# ----
# 阳角埋件布置
pt_32 = Point(item_40)
explode_10 = Explode(Curve=crv_22, Recursive=True)  # -> Segments, Vertices
cp_2 = ClosestPoint(Point=pt_32, Cloud=explode_10.Vertices)  # -> ClosestPoint, CPIndex, Distance
cir_3 = Circle(Plane=cp_2.ClosestPoint, Radius=Slider(150, range=0..1000))
pt_33 = Point(cp_2.ClosestPoint)
ccx_18 = CurveCurve(CurveA=cir_3, CurveB=offset)  # -> Points, ParamsA, ParamsB
item_42 = ListItem(List=ccx_18.Points, Index=0, Wrap=True)  # -> Item, Item1
ln_27 = Line(StartPoint=graft(pt_33), EndPoint=graft(item_42.Item))  # -> flatten(Line)
ln_28 = Line(StartPoint=graft(pt_33), EndPoint=graft(item_42.Item1))  # -> flatten(Line)
item_43 = ListItem(List=filter_16, Index="1", Wrap=True)
pl_8 = ConstructPlane(Origin=pt_33, XAxis=ln_27, YAxis=ln_28)
bbox_6 = BoundingBox(Content=graft(item_43), Plane=PlaneXY(0, 0, 0))  # -> Box, Box_2
srf = Surface(bbox_6.Box)
explode_11 = Explode(Curve=srf, Recursive=True)  # -> Segments, Vertices
item_44 = ListItem(List=explode_11.Vertices, Index=0, Wrap=True)  # -> Item, Item1, Item2
ln_29 = Line(StartPoint=graft(item_44.Item1), EndPoint=graft(item_44.Item2))
ln_30 = Line(StartPoint=graft(item_44.Item1), EndPoint=graft(item_44.Item))
ln_31 = Line(StartPoint=graft(item_44.Item1), EndPoint=graft(item_44.Item))
ln_32 = Line(StartPoint=graft(item_44.Item1), EndPoint=graft(item_44.Item2))
pl_9 = ConstructPlane(Origin=item_44.Item1, XAxis=ln_32, YAxis=ln_31)
pl_10 = ConstructPlane(Origin=item_44.Item1, XAxis=ln_30, YAxis=ln_29)
orient_6 = Orient(Geometry=item_43, Source=pl_10, Target=pl_8)  # -> Geometry, Transform
orient_7 = Orient(Geometry=item_43, Source=pl_9, Target=pl_8)  # -> Geometry, Transform
merge_18 = Merge(Data1=orient_6.Geometry, Data2=orient_7.Geometry)
filter_24 = StreamFilter(Gate=list_2, Stream0=orient_6.Geometry, Stream1=merge_18)
bbox_7 = BoundingBox(Content=filter_24, Plane=PlaneXY(0, 0, 0))  # -> Box, Box_2
entwine_13 = Entwine(Branch00=filter_24, Branch01=bbox_7.Box, FlattenInputs=True)
flip_3 = FlipMatrix(Data=entwine_13)
item_45 = ListItem(List=flip_3, Index=-1, Wrap=True)  # -> flatten(Item)
item_46 = ListItem(List=flip_3, Index="0", Wrap=True)  # -> flatten(Item)

# ---- group: 阴角
# 阴角埋件布置
explode_12 = Explode(Curve=crv_22, Recursive=True)  # -> Segments, Vertices
cp_3 = ClosestPoint(Point=item_39, Cloud=explode_12.Vertices)  # -> ClosestPoint, CPIndex, Distance
pshift_5 = ShiftPaths(Data=item_41, Offset=-1)
crv_cp_9 = CurveClosestPoint(Point=pshift_5, Curve=offset_10)  # -> Point, Parameter, Distance
crv_cp_10 = CurveClosestPoint(Point=pshift_5, Curve=offset)  # -> Point, Parameter, Distance
vec2pt_3 = Vector2Pt(PointA=crv_cp_9.Point, PointB=crv_cp_10.Point, Unitize=False)  # -> expr("-x", Vector), Length
eval_7 = EvaluateCurve(Curve=offset, Parameter=crv_cp_10.Parameter)  # -> Point, Tangent, Angle
pl_11 = ConstructPlane(Origin=crv_cp_10.Point, XAxis=eval_7.Tangent, YAxis=vec2pt_3.Vector)
orient_8 = Orient(Geometry=block, Source=PlaneXY(0, 0, 0), Target=pl_11)  # -> Geometry, Transform

# ---- group: 大面 (continued)
crv_cp_11 = CurveClosestPoint(Point=merge_17, Curve=offset_10)  # -> Point, Parameter, Distance
crv_cp_12 = CurveClosestPoint(Point=merge_17, Curve=offset)  # -> Point, Parameter, Distance
vec2pt_4 = Vector2Pt(PointA=crv_cp_11.Point, PointB=crv_cp_12.Point, Unitize=False)  # -> expr("-x", Vector), Length
eval_8 = EvaluateCurve(Curve=offset, Parameter=crv_cp_12.Parameter)  # -> Point, Tangent, Angle
pl_12 = ConstructPlane(Origin=crv_cp_12.Point, XAxis=eval_8.Tangent, YAxis=vec2pt_4.Vector)
orient_9 = Orient(Geometry=block, Source=PlaneXY(0, 0, 0), Target=pl_12)  # -> flatten(Geometry), Transform

# ---- group: Datea / 2
lng_5 = ListLength(List=orient_9.Geometry)
division_10 = Division(A=lng_5, B=2)
split_2 = SplitList(List=orient_9.Geometry, Index=division_10)  # -> ListA, ListB
data_55 = Data(split_2.ListA)

# ----
bbox_8 = BoundingBox(Content=data_55, Plane=PlaneXY(0, 0, 0))  # -> Box, Box_2
entwine_14 = Entwine(Branch00=data_55, Branch01=bbox_8.Box, FlattenInputs=True)
flip_4 = FlipMatrix(Data=entwine_14)
item_47 = ListItem(List=flip_4, Index=-1, Wrap=True)  # -> flatten(Item)
item_48 = ListItem(List=flip_4, Index="0", Wrap=True)  # -> flatten(Item)
阴角 = Geometry(orient_8.Geometry)

# ---- group: Monomer + Side/Top / Monomer Type
filter_25 = StreamFilter(Gate=list, Stream0=item_45, Stream1=item_45, Stream2=item_45)

# ----
# 槽埋-角部倾斜时
bbox_9 = BoundingBox(Content=item_45, Plane=PlaneXY(0, 0, 0))  # -> Box, Box_2
ln_33 = Line(StartPoint=pt_32, EndPoint=pt_33)
debrep = DeconstructBrep(Brep=bbox_9.Box)  # -> Faces, Edges, Vertices
deplane_28 = DeconstructPlane(Plane=ln_33)  # -> Origin, XAxis, YAxis, ZAxis
len_7 = Length(Curve=debrep.Edges)
sort_20 = SortList(Keys=len_7, ValuesA=debrep.Edges)  # -> Keys, reverse(ValuesA)
amp_18 = Amplitude(Vector=deplane_28.XAxis, Amplitude=Slider(63.5, range=10..100))
item_49 = ListItem(List=sort_20.ValuesA, Index=0, Wrap=True)  # -> Item, Item1, Item2
item_50 = ListItem(List=sort_20.ValuesA, Index=0, Wrap=True)
move_29 = Move(Geometry=deplane_28.Origin, Motion=amp_18)  # -> Geometry, Transform
len_8 = Length(Curve=item_50)
end_9 = EndPoints(Curve=item_49.Item2)  # -> Start, End
end_10 = EndPoints(Curve=item_49.Item1)  # -> Start, End
ln_34 = Line(StartPoint=deplane_28.Origin, EndPoint=move_29.Geometry)
ln_35 = Line(StartPoint=move_29.Geometry, EndPoint=deplane_28.Origin)
avr = Average(Input=[end_10.Start, end_10.End])
ln_36 = Line(StartPoint=end_9.Start, EndPoint=end_9.End)
ln_37 = Line(StartPoint=end_10.Start, EndPoint=avr)
c_script_5 = CSharpScript(iReset=Toggle(True), turns=Slider(30, range=0..100), steps=Slider(10, range=0..10))  # -> out, num; inputs numDefault: Double, iReset: Boolean, turns: Int32, steps: Double
# ---------- c_script_5: C# ----------
    if(iReset){
      number = 0;}

    for(int i = 0; i < turns;i++){
      number = number + steps;
      numStore.Add(number);
      Print(number.ToString());}

    num = numStore;
# ---------- c_script_5: C# additional code ----------
  double number = 0;
  List <double> numStore = new List<double>();
# ---------- end c_script_5 ----------
pl_13 = ConstructPlane(Origin=avr, XAxis=ln_37, YAxis=ln_36)
panel_48 = Panel(c_script_5.num)
amp_19 = Amplitude(Vector=ln_33, Amplitude=graft(c_script_5.num))

item_51 = ListItem(List=flatten(len_8), Index=0, Wrap=True)

ln_38 = Line(StartPoint=pt_32, EndPoint=pt_33)
move_30 = Move(Geometry=pt_33, Motion=ln_38)  # -> Geometry, Transform
ccx_19 = CurveCurve(CurveA=cir_3, CurveB=offset)  # -> Points, ParamsA, ParamsB
item_52 = ListItem(List=ccx_19.Points, Index=0, Wrap=True)  # -> flatten(Item), flatten(Item1)
ln_39 = Line(StartPoint=pt_33, EndPoint=item_52.Item)
ln_40 = Line(StartPoint=pt_33, EndPoint=move_30.Geometry)
ln_41 = Line(StartPoint=pt_33, EndPoint=item_52.Item1)
angle_5 = Angle(VectorA=ln_39, VectorB=ln_40)  # -> Angle, Reflex
angle_6 = Angle(VectorA=ln_41, VectorB=ln_40)  # -> Angle, Reflex
deg_8 = Degrees(Radians=angle_5.Angle)
deg_9 = Degrees(Radians=angle_6.Angle)
item_53 = ListItem(List=ln_40, Index=Slider(3, range=0..4), Wrap=True)
tan = Tangent(Value=degrees(deg_8))
entwine_15 = Entwine(Branch00=ln_39, Branch01=tan, FlattenInputs=True)
tan_2 = Tangent(Value=degrees(deg_9))
division_11 = Division(A=tan, B=tan_2)
panel_49 = Panel(deg_9)
panel_50 = Panel(deg_8)
addition_7 = Addition(A=division_11, B=1)
division_12 = Division(A="1", B=addition_7)
subtraction = Subtraction(A="1", B=division_12)
num = Number(division_12)
larger_9 = LargerThan(FirstNumber=tan, SecondNumber=tan_2)  # -> LargerThan, OrEqualTo

amp_20 = Amplitude(Vector=ln_35, Amplitude=expr("x/2", flatten(item_51)))
amp_21 = Amplitude(Vector=ln_34, Amplitude=expr("x/2", flatten(item_51)))
move_31 = Move(Geometry=pt_33, Motion=amp_20)  # -> Geometry, Transform
move_32 = Move(Geometry=pt_33, Motion=amp_21)  # -> Geometry, Transform
ln_42 = Line(StartPoint=move_31.Geometry, EndPoint=move_32.Geometry)

crv_64 = Curve(ln_42)
mp = Midpoint(Curve=crv_64)
eval_9 = EvaluateCurve(Curve=crv_64, Parameter=subtraction)  # -> Point, Tangent, Angle
eval_10 = EvaluateCurve(Curve=crv_64, Parameter=num)  # -> Point, Tangent, Angle
dispatch_38 = Dispatch(List=eval_9.Point, DispatchPattern=larger_9.OrEqualTo)  # -> ListA, ListB
dispatch_39 = Dispatch(List=eval_10.Point, DispatchPattern=larger_9.OrEqualTo)  # -> ListA, ListB
pt_34 = Point(dispatch_38.ListB)
pt_35 = Point(dispatch_39.ListA)
merge_19 = Merge(Data1=pt_35, Data2=pt_34)
pull_26 = PullPoint(Point=merge_19, Geometry=graft(mp), ClosestOnly=True)  # -> ClosestPoint, Distance
panel_51 = Panel(merge_19)
sort_21 = SortList(Keys=pull_26.Distance, ValuesA=merge_19)  # -> Keys, ValuesA
item_54 = ListItem(List=sort_21.ValuesA, Index=0, Wrap=True)  # -> flatten(Item)
ln_43 = Line(StartPoint=item_54, EndPoint=mp)
panel_52 = Panel(item_54)
move_33 = Move(Geometry=crv_64, Motion=ln_43)  # -> Geometry, Transform

# ---- group: 正常和阳角 - BoundingBox — 测Intersection
entwine_16 = Entwine(Branch00=flip.Curve, Branch01=offset, FlattenInputs=True)
flip_5 = FlipMatrix(Data=entwine_16)
item_55 = ListItem(List=flip_5, Index=0, Wrap=True)  # -> Item, Item1

# ----
move_34 = Move(Geometry=move_33.Geometry, Motion=amp_19)  # -> Geometry, Transform
ccx_20 = CurveCurve(CurveA=move_34.Geometry, CurveB=crv_22)  # -> Points, ParamsA, ParamsB
item_56 = ListItem(List=ccx_20.Points, Index=0, Wrap=True)
item_57 = ListItem(List=ccx_20.Points, Index="-1", Wrap=True)
pshift_6 = ShiftPaths(Data=item_56, Offset=-1)
pshift_7 = ShiftPaths(Data=item_57, Offset=-1)
flip_6 = FlipMatrix(Data=pshift_6)
flip_7 = FlipMatrix(Data=pshift_7)
pt_36 = Point(flip_6)
pt_37 = Point(flip_7)
pull_27 = PullPoint(Point=pt_36, Geometry=graft(mp), ClosestOnly=True)  # -> ClosestPoint, Distance
pull_28 = PullPoint(Point=pt_37, Geometry=graft(mp), ClosestOnly=True)  # -> ClosestPoint, Distance
sort_22 = SortList(Keys=pull_27.Distance, ValuesA=pt_36)  # -> Keys, ValuesA
sort_23 = SortList(Keys=pull_28.Distance, ValuesA=pt_37)  # -> Keys, ValuesA
item_58 = ListItem(List=sort_22.ValuesA, Index="-1", Wrap=True)
item_59 = ListItem(List=sort_23.ValuesA, Index="-1", Wrap=True)
ln_44 = Line(StartPoint=item_59, EndPoint=item_58)

end_11 = EndPoints(Curve=ln_44)  # -> Start, End

avr_2 = Average(Input=[end_11.Start, end_11.End])
pl_14 = ConstructPlane(Origin=avr_2, XAxis=ln_44, YAxis=graft(ln_33))
orient_10 = Orient(Geometry=graft(item_46), Source=pl_13, Target=pl_14)  # -> Geometry, Transform
orient_11 = Orient(Geometry=graft(item_45), Source=pl_13, Target=pl_14)  # -> Geometry, Transform

filter_26 = StreamFilter(Gate=list_8, Stream0=item_45, Stream1=orient_11.Geometry)

# ---- group: Monomer + Side/Top / Monomer Type (continued)
filter_27 = StreamFilter(Gate=list, Stream0=item_45, Stream1=filter_26, Stream2=item_45)

# ---- group: Monomer + Side/Top / Top/Side
filter_28 = StreamFilter(Gate=list_2, Stream0=filter_27, Stream1=filter_25)

# ----
filter_29 = StreamFilter(Gate=list_8, Stream0=item_46, Stream1=orient_10.Geometry)

# ---- group: 阳角分类
filter_30 = StreamFilter(Gate=list, Stream0=item_46, Stream1=filter_29, Stream2=item_46)
filter_31 = StreamFilter(Gate=list, Stream0=item_46, Stream1=item_46, Stream2=item_46)
filter_32 = StreamFilter(Gate=list_2, Stream0=filter_30, Stream1=filter_31)

# ----
阳角 = Geometry(filter_32)

# ---- group: 正常和阳角 - BoundingBox — 测Intersection (continued)
c_script_6 = CSharpScript(BrepMain=item_47, BrepStay=filter_28)  # -> out, BrepInters, BrepRemain, IndexM, IndexS; inputs BrepMain: list of Brep, BrepStay: list of Brep
# ---------- c_script_6: C# ----------
    List<Brep> BrepI = new List<Brep>();
    List<Brep> BrepR = new List<Brep>();
    List<int> num = new List<int>();
    List<int> numS = new List<int>();


    double tolr = Rhino.RhinoDoc.ActiveDoc.ModelAbsoluteTolerance;

    for(int j = 0; j < BrepMain.Count;j++){
      for(int i = 0; i < BrepStay.Count;i++){
        bool test = Rhino.Geometry.Intersect.Intersection.BrepBrep(BrepMain[j], BrepStay[i], tolr, out crv, out pts);
        if(test && crv.Length != 0){
          tryThis = true;
          numS.Add(i);
          break;}
        else{
          tryThis = false;}
      }
      if(tryThis){
        BrepI.Add(BrepMain[j]);
        num.Add(j);
      }
      else{
        BrepR.Add(BrepMain[j]);
      }
    }



    BrepInters = BrepI;
    BrepRemain = BrepR;
    IndexM = num;
    IndexS = numS;
# ---------- c_script_6: C# additional code ----------
  Rhino.Geometry.Curve[] crv;
  Rhino.Geometry.Point3d[] pts;
  bool tryThis;
# ---------- end c_script_6 ----------
item_60 = ListItem(List=item_47, Index=c_script_6.IndexM, Wrap=True)  # -> graft(Item)
item_61 = ListItem(List=filter_28, Index=c_script_6.IndexS, Wrap=True)  # -> graft(Item)
cull_i_19 = CullIndex(List=item_48, Indices=c_script_6.IndexM, Wrap=True)
item_62 = ListItem(List=item_48, Index=c_script_6.IndexM, Wrap=True)  # -> graft(Item)
area_14 = Area(Geometry=item_60)  # -> Area, Centroid
bbx = BrepBrep(BrepA=item_60, BrepB=item_61)  # -> simplify(Curves), Points
area_15 = Area(Geometry=bbx.Curves)  # -> Area, Centroid
ln_45 = Line(StartPoint=area_14.Centroid, EndPoint=area_15.Centroid)
mp_2 = Midpoint(Curve=ln_45)
scale_14 = Scale(Geometry=ln_45, Center=mp_2, Factor=Slider(1000000, range=0..1000000))  # -> Geometry, Transform
ccx_21 = CurveCurve(CurveA=scale_14.Geometry, CurveB=bbx.Curves)  # -> Points, ParamsA, ParamsB
item_63 = ListItem(List=ccx_21.Points, Index=0, Wrap=True)  # -> Item, Item1
ln_46 = Line(StartPoint=item_63.Item1, EndPoint=item_63.Item)
move_35 = Move(Geometry=item_62, Motion=ln_46)  # -> simplify(Geometry), Transform
bbox_10 = BoundingBox(Content=move_35.Geometry, Plane=PlaneXY(0, 0, 0))  # -> Box, Box_2

# ----
# 这里如果跑红也不要紧，
# 说明单体没有出现相撞的情况
area_16 = Area(Geometry=bbox_10.Box)  # -> Area, Centroid

# ---- group: 正常和阳角 - BoundingBox — 测Intersection (continued)
entwine_17 = Entwine(Branch00=move_35.Geometry, Branch01=area_16.Centroid, FlattenInputs=True)
flip_8 = FlipMatrix(Data=entwine_17)
item_64 = ListItem(List=flip_8, Index="0", Wrap=True)  # -> flatten(Item)
item_65 = ListItem(List=flip_8, Index="-1", Wrap=True)  # -> flatten(Item)
pull_29 = PullPoint(Point=item_65, Geometry=item_55.Item, ClosestOnly=True)  # -> flatten(ClosestPoint), Distance
pull_30 = PullPoint(Point=item_65, Geometry=item_55.Item1, ClosestOnly=True)  # -> flatten(ClosestPoint), Distance
vec2pt_5 = Vector2Pt(PointA=item_65, PointB=pull_29.ClosestPoint, Unitize=False)  # -> Vector, Length
vec2pt_6 = Vector2Pt(PointA=item_65, PointB=pull_30.ClosestPoint, Unitize=False)  # -> Vector, Length
multiplication_13 = Multiplication(A=vec2pt_5.Vector, B=vec2pt_6.Vector)
larger_10 = LargerThan(FirstNumber=multiplication_13, SecondNumber=0)  # -> LargerThan, OrEqualTo
dispatch_40 = Dispatch(List=item_64, DispatchPattern=larger_10.LargerThan)  # -> ListA, ListB

# ---- group: Normal
geo_7 = Geometry(cull_i_19)

# ---- group: Normal-Move
移动 = Geometry(dispatch_40.ListA)

# ----
# PLAN Results
merge_20 = Merge(Data1=geo_7, Data2=阳角, Data3=移动, Data4=阴角)

# ----
# 1.0无檐口线+上下层幕墙边线连续
pln_22 = Plane(dispatch_35.ListA)
crv_65 = Curve(crv_7)
crv_66 = Curve(crv_10)
deplane_29 = DeconstructPlane(Plane=pln_22)  # -> Origin, XAxis, YAxis, ZAxis
number_slider_26 = Slider(3584, range=0..10000)
amp_22 = Amplitude(Vector=deplane_29.YAxis, Amplitude=number_slider_26)
amp_23 = Amplitude(Vector=deplane_29.YAxis, Amplitude=expr("-x", number_slider_26))
move_36 = Move(Geometry=deplane_29.Origin, Motion=amp_22)  # -> Geometry, Transform
move_37 = Move(Geometry=deplane_29.Origin, Motion=amp_23)  # -> Geometry, Transform
ln_47 = Line(StartPoint=move_37.Geometry, EndPoint=move_36.Geometry)
ccx_22 = CurveCurve(CurveA=ln_47, CurveB=crv_65)  # -> flatten(Points), ParamsA, ParamsB
ccx_23 = CurveCurve(CurveA=ln_47, CurveB=crv_66)  # -> flatten(Points), ParamsA, ParamsB
pull_31 = PullPoint(Point=ccx_23.Points, Geometry=ccx_22.Points, ClosestOnly=True)  # -> ClosestPoint, Distance
sort_24 = SortList(Keys=pull_31.Distance, ValuesA=pull_31.ClosestPoint)  # -> Keys, ValuesA
panel_53 = Panel(sort_24.Keys)
larger_11 = LargerThan(FirstNumber=sort_24.Keys, SecondNumber=Slider(1.1, range=0..10))  # -> LargerThan, OrEqualTo
dispatch_41 = Dispatch(List=sort_24.ValuesA, DispatchPattern=larger_11.LargerThan)  # -> ListA, ListB
pt_38 = Point(dispatch_41.ListB)
pt_39 = Point(dispatch_41.ListA)
pull_32 = PullPoint(Point=deplane_29.Origin, Geometry=graft(pt_38), ClosestOnly=True)  # -> ClosestPoint, Distance

pln_23 = Plane(pln_22)

sort_25 = SortList(Keys=pull_32.Distance, ValuesA=pln_23)  # -> Keys, ValuesA
item_66 = ListItem(List=sort_25.ValuesA, Index=0, Wrap=True)
check_same_points_6 = CheckSamePoints(archPoint=pln_23, crvPoint=flatten(item_66))  # -> out, specialPt; inputs archPoint: list of Point3d, crvPoint: list of Point3d; same code as testpoint
item_67 = ListItem(List=pln_23, Index=check_same_points_6.specialPt, Wrap=True)
deplane_30 = DeconstructPlane(Plane=item_67)  # -> Origin, XAxis, YAxis, ZAxis
amp_24 = Amplitude(Vector=deplane_30.YAxis, Amplitude=expr("-x", Slider(2756, range=0..10000)))
move_38 = Move(Geometry=deplane_30.Origin, Motion=amp_24)  # -> Geometry, Transform
ln_48 = Line(StartPoint=deplane_30.Origin, EndPoint=move_38.Geometry)
ccx_24 = CurveCurve(CurveA=graft(ln_48), CurveB=flatten(crv_30))  # -> Points, ParamsA, ParamsB
shift_2 = ShiftPaths(Data=ccx_24.Points, Offset=-1)

pull_33 = PullPoint(Point=deplane_30.Origin, Geometry=shift_2, ClosestOnly=True)  # -> ClosestPoint, Distance
sort_26 = SortList(Keys=pull_33.Distance, ValuesA=pull_33.ClosestPoint)  # -> Keys, ValuesA
item_68 = ListItem(List=sort_26.ValuesA, Index=0, Wrap=True)

null_10 = NullItem(Item=flatten(item_68))  # -> NullFlags, InvalidFlags, Description
dispatch_42 = Dispatch(List=item_67, DispatchPattern=null_10.InvalidFlags)  # -> ListA, ListB
dispatch_43 = Dispatch(List=item_68, DispatchPattern=item_68)  # -> ListA, ListB
data_56 = Data(dispatch_43.ListA)
data_57 = Data(dispatch_42.ListB)

# ----
# 1.0无檐口线
# 与梁不相交
disc_14 = Discontinuity(Curve=crv_30, Level=1)  # -> Points, Parameters
pln_24 = Plane(dispatch_42.ListA)
pull_34 = PullPoint(Point=pln_24, Geometry=flatten(disc_14.Points), ClosestOnly=True)  # -> ClosestPoint, Distance
check_same_points_7 = CheckSamePoints(archPoint=flatten(disc_14.Points), crvPoint=pull_34.ClosestPoint)  # -> out, specialPt; inputs archPoint: list of Point3d, crvPoint: list of Point3d; same code as testpoint
item_69 = ListItem(List=flatten(disc_14.Points), Index=check_same_points_7.specialPt, Wrap=True)
cull_i_20 = CullIndex(List=flatten(disc_14.Points), Indices=check_same_points_7.specialPt, Wrap=True)
pull_35 = PullPoint(Point=item_69, Geometry=cull_i_20, ClosestOnly=True)  # -> ClosestPoint, Distance
pt_40 = Point(item_69)
pt_41 = Point(pull_35.ClosestPoint)
ln_49 = Line(StartPoint=pt_40, EndPoint=pt_41)
number_slider_27 = Slider(500, range=0..1000)
midpt_21 = CurveMiddle(Curve=ln_49)
deplane_31 = DeconstructPlane(Plane=pln_24)  # -> Origin, XAxis, YAxis, ZAxis
amp_25 = Amplitude(Vector=deplane_31.XAxis, Amplitude=number_slider_27)
amp_26 = Amplitude(Vector=deplane_31.XAxis, Amplitude=expr("-x", number_slider_27))
move_39 = Move(Geometry=midpt_21, Motion=amp_25)  # -> Geometry, Transform
move_40 = Move(Geometry=midpt_21, Motion=amp_26)  # -> Geometry, Transform
entwine_18 = Entwine(Branch00=move_39.Geometry, Branch01=move_40.Geometry, FlattenInputs=True)
entwine_19 = Entwine(Branch00=deplane_31.Origin, Branch01=deplane_31.Origin, FlattenInputs=True)

# ----
# 1.0无檐口线+上下层幕墙边线连续
# 01：钢板焊埋件[钢梁外侧]
# @钢边梁宽@钢边梁高
move2pt_17 = MoveToPoint(Geometry=data_57, PointA=data_57, PointB=flatten(data_56))  # -> Moved, Vector, Transform
move2pt_18 = MoveToPoint(Geometry=pln_24, PointA=entwine_19, PointB=entwine_18)  # -> Moved, Vector, Transform

pln_25 = Plane(pln_20)
crv_67 = Curve(filter_8)
deplane_32 = DeconstructPlane(Plane=pln_25)  # -> Origin, XAxis, YAxis, ZAxis
incurve_3 = PointInCurve(Point=deplane_32.Origin, Curve=crv_67)  # -> Relationship, Point
equals_5 = Equality(FirstNumber=incurve_3.Relationship, SecondNumber="2")  # -> Equality, Inequality
dispatch_44 = Dispatch(List=pln_25, DispatchPattern=equals_5.Equality)  # -> ListA, ListB
cull_i_21 = CullIndex(List=pln_23, Indices=check_same_points_6.specialPt, Wrap=True)
data_58 = Data(dispatch_44.ListB)
data_59 = Data(dispatch_44.ListA)
merge_21 = Merge(Data1=cull_i_21, Data2=data_59)  # -> flatten(Result)

pln_26 = Plane(merge_21)

# ----
# 有问题
crv_68 = Curve(crv_9)
crv_69 = Curve(filter_8)
crv_70 = Curve(crv_10)
pln_27 = Plane(pln_26)
deplane_33 = DeconstructPlane(Plane=pln_27)  # -> Origin, XAxis, YAxis, ZAxis

# ----
# 1.2是否有吊顶
crv_71 = Curve(crv_68)
offset_11 = OffsetCurve(Curve=crv_71, Distance=number_slider_6, Corners=1)
offset_12 = OffsetCurve(Curve=crv_71, Distance=expr("-x", number_slider_6), Corners=1)
midpt_22 = CurveMiddle(Curve=offset_11)
midpt_23 = CurveMiddle(Curve=flatten(offset_12))
midpt_24 = CurveMiddle(Curve=flatten(crv_71))
pull_36 = PullPoint(Point=midpt_24, Geometry=crv_69, ClosestOnly=True)  # -> ClosestPoint, Distance
pull_37 = PullPoint(Point=midpt_24, Geometry=flatten(midpt_22), ClosestOnly=True)  # -> ClosestPoint, Distance
pull_38 = PullPoint(Point=midpt_24, Geometry=flatten(midpt_23), ClosestOnly=True)  # -> ClosestPoint, Distance
ln_50 = Line(StartPoint=pull_36.ClosestPoint, EndPoint=pull_37.ClosestPoint)
ln_51 = Line(StartPoint=pull_36.ClosestPoint, EndPoint=pull_38.ClosestPoint)
ccx_25 = CurveCurve(CurveA=graft(ln_50), CurveB=crv_71)  # -> Points, ParamsA, ParamsB
pshift_8 = ShiftPaths(Data=ccx_25.Points, Offset=-1)
null_11 = NullItem(Item=pshift_8)  # -> NullFlags, flatten(InvalidFlags), Description
dispatch_45 = Dispatch(List=crv_71, DispatchPattern=null_11.InvalidFlags)  # -> ListA, ListB
data_60 = Data(dispatch_45.ListB)
data_61 = Data(dispatch_45.ListA)
addition_8 = Addition(A=number_slider_6, B=number_slider_7)
offset_13 = OffsetCurve(Curve=data_61, Distance=expr("-x", addition_8), Corners=1)
offset_14 = OffsetCurve(Curve=data_60, Distance=addition_8, Corners=1)

# ----
# 内测梁边线
merge_22 = Merge(Data1=offset_13, Data2=offset_14)

amp_27 = Amplitude(Vector=deplane_33.YAxis, Amplitude=expr("-x", addition_8))
move_41 = Move(Geometry=deplane_33.Origin, Motion=amp_27)  # -> Geometry, Transform
move2pt_19 = MoveToPoint(Geometry=pln_27, PointA=deplane_33.Origin, PointB=move_41.Geometry)  # -> Moved, Vector, Transform
incurve_4 = PointInCurve(Point=move_41.Geometry, Curve=crv_70)  # -> Relationship, Point
equals_6 = Equality(FirstNumber=incurve_4.Relationship, SecondNumber="0")  # -> Equality, Inequality
dispatch_46 = Dispatch(List=move2pt_19.Moved, DispatchPattern=equals_6.Equality)  # -> ListA, ListB
pln_28 = Plane(dispatch_46.ListB)

# ----
# 1.2.1梁以内>350
# 
# 侧埋，钢板焊
pln_29 = Plane(dispatch_46.ListA)

# ----
# 2.2下层建筑边线内侧300-600mm范围内
number_slider_28 = Slider(600, range=0..1000)
crv_72 = Curve(crv_70)
offset_15 = OffsetCurve(Curve=crv_72, Distance=expr("-x", number_slider_28), Corners=1)
offset_16 = OffsetCurve(Curve=crv_72, Distance=expr("-x", Slider(300, range=0..1000)), Corners=1)

# ----
# 2.1下层建筑边线外侧50-350mm范围内
number_slider_29 = Slider(350, range=0..1000)
crv_73 = Curve(crv_70)
offset_17 = OffsetCurve(Curve=crv_73, Distance=Slider(50, range=0..100), Corners=1)
offset_18 = OffsetCurve(Curve=crv_73, Distance=number_slider_29, Corners=1)

pln_30 = Plane(pln_26)
number_slider_30 = Slider(3584, range=0..10000)
deplane_34 = DeconstructPlane(Plane=pln_30)  # -> Origin, XAxis, YAxis, ZAxis
amp_28 = Amplitude(Vector=deplane_34.YAxis, Amplitude=number_slider_30)
amp_29 = Amplitude(Vector=deplane_34.YAxis, Amplitude=expr("-x", number_slider_30))
move_42 = Move(Geometry=deplane_34.Origin, Motion=amp_29)  # -> Geometry, Transform
move_43 = Move(Geometry=deplane_34.Origin, Motion=amp_28)  # -> Geometry, Transform
ln_52 = Line(StartPoint=move_42.Geometry, EndPoint=move_43.Geometry)
ccx_26 = CurveCurve(CurveA=ln_52, CurveB=offset_17)  # -> Points, ParamsA, ParamsB
ccx_27 = CurveCurve(CurveA=ln_52, CurveB=offset_18)  # -> Points, ParamsA, ParamsB
ln_53 = Line(StartPoint=ccx_26.Points, EndPoint=ccx_27.Points)  # -> flatten(Line)
len_9 = Length(Curve=ln_53)
sort_27 = SortList(Keys=len_9)  # -> Keys, ValuesA
# 待完善
panel_54 = Panel(sort_27.Keys)
larger_12 = LargerThan(FirstNumber=len_9, SecondNumber=number_slider_8)  # -> LargerThan, OrEqualTo
dispatch_47 = Dispatch(List=ln_53, DispatchPattern=larger_12.LargerThan)  # -> ListA, ListB
line = Line(dispatch_47.ListA)
line_2 = Line(dispatch_47.ListB)
ccx_28 = CurveCurve(CurveA=line_2, CurveB=merge_3)  # -> Points, ParamsA, ParamsB
pt_42 = Point(flatten(ccx_28.Points))
pull_39 = PullPoint(Point=deplane_34.Origin, Geometry=graft(pt_42), ClosestOnly=True)  # -> ClosestPoint, Distance
sort_28 = SortList(Keys=pull_39.Distance, ValuesA=pln_30)  # -> Keys, ValuesA
item_70 = ListItem(List=sort_28.ValuesA, Index=0, Wrap=True)  # -> flatten(Item)
check_same_points_8 = CheckSamePoints(archPoint=pln_30, crvPoint=item_70)  # -> out, specialPt; inputs archPoint: list of Point3d, crvPoint: list of Point3d; same code as testpoint
item_71 = ListItem(List=pln_30, Index=check_same_points_8.specialPt, Wrap=True)
deplane_35 = DeconstructPlane(Plane=item_71)  # -> Origin, XAxis, YAxis, ZAxis
pull_40 = PullPoint(Point=deplane_35.Origin, Geometry=pt_42, ClosestOnly=True)  # -> ClosestPoint, Distance

pln_31 = Plane(pln_30)
number_slider_31 = Slider(3584, range=0..10000)
deplane_36 = DeconstructPlane(Plane=pln_31)  # -> Origin, XAxis, YAxis, ZAxis
amp_30 = Amplitude(Vector=deplane_36.YAxis, Amplitude=number_slider_31)
amp_31 = Amplitude(Vector=deplane_36.YAxis, Amplitude=expr("-x", number_slider_31))
move_44 = Move(Geometry=deplane_36.Origin, Motion=amp_31)  # -> Geometry, Transform
move_45 = Move(Geometry=deplane_36.Origin, Motion=amp_30)  # -> Geometry, Transform
ln_54 = Line(StartPoint=move_44.Geometry, EndPoint=move_45.Geometry)
ccx_29 = CurveCurve(CurveA=ln_54, CurveB=offset_15)  # -> Points, ParamsA, ParamsB
ccx_30 = CurveCurve(CurveA=ln_54, CurveB=offset_16)  # -> Points, ParamsA, ParamsB
ln_55 = Line(StartPoint=ccx_29.Points, EndPoint=ccx_30.Points)  # -> flatten(Line)
len_10 = Length(Curve=ln_55)
sort_29 = SortList(Keys=len_10)  # -> Keys, ValuesA
panel_55 = Panel(sort_29.Keys)
larger_13 = LargerThan(FirstNumber=len_10, SecondNumber=number_slider_9)  # -> LargerThan, OrEqualTo
dispatch_48 = Dispatch(List=ln_55, DispatchPattern=larger_13.LargerThan)  # -> ListA, ListB
line_3 = Line(dispatch_48.ListA)
line_4 = Line(dispatch_48.ListB)
ccx_31 = CurveCurve(CurveA=line_4, CurveB=crv_32)  # -> Points, ParamsA, ParamsB
pt_43 = Point(flatten(ccx_31.Points))
pull_41 = PullPoint(Point=deplane_36.Origin, Geometry=graft(pt_43), ClosestOnly=True)  # -> ClosestPoint, Distance
sort_30 = SortList(Keys=pull_41.Distance, ValuesA=pln_31)  # -> Keys, ValuesA
item_72 = ListItem(List=sort_30.ValuesA, Index=0, Wrap=True)  # -> flatten(Item)
check_same_points_9 = CheckSamePoints(archPoint=pln_31, crvPoint=item_72)  # -> out, specialPt; inputs archPoint: list of Point3d, crvPoint: list of Point3d; same code as testpoint
item_73 = ListItem(List=pln_31, Index=check_same_points_9.specialPt, Wrap=True)
deplane_37 = DeconstructPlane(Plane=item_73)  # -> Origin, XAxis, YAxis, ZAxis
pull_42 = PullPoint(Point=item_73, Geometry=pt_43, ClosestOnly=True)  # -> ClosestPoint, Distance

# ----
# 1.2.2
# 下层建筑边线外侧50-350mm
# 03：钢板焊埋件[钢梁内侧]
# @钢边梁宽@钢边梁高
move2pt_20 = MoveToPoint(Geometry=item_71, PointA=deplane_35.Origin, PointB=pull_40.ClosestPoint)  # -> Moved, Vector, Transform

# ----
# 1.2.3
# 下层建筑边线内侧300-600mm范围
# 03：钢板焊埋件[钢梁外侧]
# @钢边梁宽@钢边梁高
move2pt_21 = MoveToPoint(Geometry=item_73, PointA=deplane_37.Origin, PointB=pull_42.ClosestPoint)  # -> Moved, Vector, Transform

# ----
# 3.1下层建筑内侧到300到外侧50内是否有钢结构
cull_i_22 = CullIndex(List=pln_31, Indices=check_same_points_9.specialPt, Wrap=True)
cull_i_23 = CullIndex(List=pln_30, Indices=check_same_points_8.specialPt, Wrap=True)
deplane_38 = DeconstructPlane(Plane=cull_i_22)  # -> Origin, XAxis, YAxis, ZAxis
deplane_39 = DeconstructPlane(Plane=cull_i_23)  # -> Origin, XAxis, YAxis, ZAxis
check_same_points_10 = CheckSamePoints(archPoint=deplane_38.Origin, crvPoint=deplane_39.Origin)  # -> out, specialPt; inputs archPoint: list of Point3d, crvPoint: list of Point3d; same code as testpoint

# ----
# 同时满足N
item_74 = ListItem(List=cull_i_22, Index=check_same_points_10.specialPt, Wrap=True)

# ----
# 不同时满足N
cull_i_24 = CullIndex(List=cull_i_22, Indices=check_same_points_10.specialPt, Wrap=True)

# ----
# 下层建筑内侧到300到外侧50内
# 有钢结构
number_slider_32 = Slider(50, range=0..1000)
crv_74 = Curve(crv_70)
offset_19 = OffsetCurve(Curve=crv_74, Distance=expr("-x", Slider(300, range=0..1000)), Corners=1)
offset_20 = OffsetCurve(Curve=crv_74, Distance=number_slider_32, Corners=1)

# ----
# 3.3上层建筑边线,
# 默认建筑提供上翻，如主结构提供示意则使用结构定位【该项目无】，
# 如无则使用建筑边线向内50mm作为埋件定位
crv_75 = Curve(crv_7)
merge_23 = Merge(Data1=item_74, Data2=cull_i_24)  # -> flatten(Result)
offset_21 = OffsetCurve(Curve=crv_75, Distance=expr("-x", Slider(50, range=0..100)), Corners=1)
pln_32 = Plane(merge_23)
number_slider_33 = Slider(3584, range=0..10000)
deplane_40 = DeconstructPlane(Plane=pln_32)  # -> Origin, XAxis, YAxis, ZAxis
amp_32 = Amplitude(Vector=deplane_40.YAxis, Amplitude=number_slider_33)
amp_33 = Amplitude(Vector=deplane_40.YAxis, Amplitude=expr("-x", number_slider_33))
move_46 = Move(Geometry=deplane_40.Origin, Motion=amp_33)  # -> Geometry, Transform
move_47 = Move(Geometry=deplane_40.Origin, Motion=amp_32)  # -> Geometry, Transform
ln_56 = Line(StartPoint=move_46.Geometry, EndPoint=move_47.Geometry)
ccx_32 = CurveCurve(CurveA=ln_56, CurveB=offset_21)  # -> flatten(Points), ParamsA, ParamsB
pull_43 = PullPoint(Point=deplane_40.Origin, Geometry=ccx_32.Points, ClosestOnly=True)  # -> ClosestPoint, Distance

# ----
# 3.3上层建筑边线,
# 默认建筑提供上翻
# 04：板埋埋件[混凝土楼板上侧]@板埋参数xn
move2pt_22 = MoveToPoint(Geometry=pln_32, PointA=deplane_40.Origin, PointB=pull_43.ClosestPoint)  # -> Moved, Vector, Transform

pln_33 = Plane(item_74)
number_slider_34 = Slider(3584, range=0..10000)
deplane_41 = DeconstructPlane(Plane=pln_33)  # -> Origin, XAxis, YAxis, ZAxis
amp_34 = Amplitude(Vector=deplane_41.YAxis, Amplitude=number_slider_34)
amp_35 = Amplitude(Vector=deplane_41.YAxis, Amplitude=expr("-x", number_slider_34))
boundary_5 = BoundarySurfaces(Edges=[offset_20, offset_19])
crv_76 = Curve(crv_31)
move_48 = Move(Geometry=deplane_41.Origin, Motion=amp_35)  # -> Geometry, Transform
move_49 = Move(Geometry=deplane_41.Origin, Motion=amp_34)  # -> Geometry, Transform
scx_2 = SurfaceCurve(Surface=boundary_5, Curve=crv_76)  # -> flatten(Curves), Points, UVPoints, Normals, Parameters, Tangents
ln_57 = Line(StartPoint=move_48.Geometry, EndPoint=move_49.Geometry)
ccx_33 = CurveCurve(CurveA=graft(ln_57), CurveB=scx_2.Curves)  # -> simplify(flatten(Points)), ParamsA, ParamsB

cullduppoints_5 = RemoveDuplicatePoints(InputPoints=ccx_33.Points, Tolerance=0.001)  # -> OutputPoints, FirstPointIndexes

pull_44 = PullPoint(Point=deplane_41.Origin, Geometry=graft(cullduppoints_5.OutputPoints), ClosestOnly=True)  # -> ClosestPoint, Distance
sort_31 = SortList(Keys=pull_44.Distance, ValuesA=pull_44.ClosestPoint)  # -> Keys, ValuesA
sort_32 = SortList(Keys=pull_44.Distance, ValuesA=pln_33)  # -> Keys, ValuesA
item_75 = ListItem(List=sort_32.ValuesA, Index=0, Wrap=True)  # -> flatten(Item)
item_76 = ListItem(List=sort_31.ValuesA, Index=0, Wrap=True)  # -> flatten(Item)
check_same_points_11 = CheckSamePoints(archPoint=pln_33, crvPoint=item_75)  # -> out, specialPt; inputs archPoint: list of Point3d, crvPoint: list of Point3d; same code as testpoint
item_77 = ListItem(List=pln_33, Index=check_same_points_11.specialPt, Wrap=True)
pull_45 = PullPoint(Point=item_77, Geometry=flatten(item_76), ClosestOnly=True)  # -> ClosestPoint, Distance
deplane_42 = DeconstructPlane(Plane=item_77)  # -> Origin, XAxis, YAxis, ZAxis

# ----
# 3.2下层建筑内侧到300到外侧50内
# 无钢结构
# 要求主体结构提供钢结构梁，默认位置为建筑边线向内300mm
number_slider_35 = Slider(300, range=0..1000)
cull_i_25 = CullIndex(List=pln_33, Indices=check_same_points_11.specialPt, Wrap=True)
crv_77 = Curve(crv_70)
offset_22 = OffsetCurve(Curve=crv_77, Distance=expr("-x", number_slider_35), Corners=1)
pull_46 = PullPoint(Point=cull_i_25, Geometry=offset_22, ClosestOnly=True)  # -> ClosestPoint, Distance
sort_33 = SortList(Keys=pull_46.Distance)  # -> Keys, ValuesA
larger_14 = LargerThan(FirstNumber=pull_46.Distance, SecondNumber=Slider(400, range=0..1000))  # -> LargerThan, OrEqualTo
dispatch_49 = Dispatch(List=cull_i_25, DispatchPattern=larger_14.LargerThan)  # -> ListA, ListB
panel_56 = Panel(sort_33.Keys)
pln_34 = Plane(dispatch_49.ListB)
number_slider_36 = Slider(3584, range=0..10000)
deplane_43 = DeconstructPlane(Plane=pln_34)  # -> Origin, XAxis, YAxis, ZAxis
amp_36 = Amplitude(Vector=deplane_43.YAxis, Amplitude=number_slider_36)
amp_37 = Amplitude(Vector=deplane_43.YAxis, Amplitude=expr("-x", number_slider_36))
move_50 = Move(Geometry=deplane_43.Origin, Motion=amp_37)  # -> Geometry, Transform
move_51 = Move(Geometry=deplane_43.Origin, Motion=amp_36)  # -> Geometry, Transform
ln_58 = Line(StartPoint=move_50.Geometry, EndPoint=move_51.Geometry)
ccx_34 = CurveCurve(CurveA=ln_58, CurveB=offset_22)  # -> flatten(Points), ParamsA, ParamsB
pull_47 = PullPoint(Point=deplane_43.Origin, Geometry=ccx_34.Points, ClosestOnly=True)  # -> ClosestPoint, Distance

# ----
# 3.1下层建筑内侧到300到外侧50内
# 底埋，钢板焊
move2pt_23 = MoveToPoint(Geometry=item_77, PointA=deplane_42.Origin, PointB=pull_45.ClosestPoint)  # -> Moved, Vector, Transform

# ----
# 3.2默认位置为建筑边线向内300mm
# 侧埋，钢板焊
# 03：钢板焊埋件[钢梁外侧]@钢边梁宽@钢边梁高
move2pt_24 = MoveToPoint(Geometry=pln_34, PointA=deplane_43.Origin, PointB=pull_47.ClosestPoint)  # -> Moved, Vector, Transform

# ----
# 做吊顶，不处理？？
pln_35 = Plane(dispatch_49.ListA)

# ==== cluster Cluster
G = ClusterInput()
rotate = Rotate(Geometry=G, Angle=3.141592654, Plane=PlaneXY(0, 0, 0))  # -> Geometry, Transform
boxprop = BoxProperties(Box=rotate.Geometry)  # -> Center, Diagonal, Area, Volume, Degeneracy
bbox = BoundingBox(Content=rotate.Geometry, Plane=PlaneXY(0, 0, 0))  # -> Box, Box_2
debox = DeconstructBox(Box=bbox.Box)  # -> Plane, X, Y, Z
pdecon = Deconstruct(Point=boxprop.Center)  # -> XComponent, YComponent, ZComponent
dedomain = DeconstructDomain(Domain=debox.Y)  # -> Start, End
pt = ConstructPoint(XCoordinate=pdecon.XComponent, YCoordinate=dedomain.Start, ZCoordinate=pdecon.ZComponent)
xy = XYPlane(Origin=Point(0, 0, 0))
pl_origin = PlaneOrigin(Base=xy, Origin=pt)
orient = Orient(Geometry=rotate.Geometry, Source=pl_origin, Target=xy)  # -> Geometry, Transform
G_2 = ClusterOutput(orient.Geometry)
